# Dynamo graph Dyn_01_Getting started_sol.dyn (Dynamo 2.12.1.8246)

# note: Important stuff
# Purple will indicate something important is going on here.
# note: Checking / Outputs
# Orange indicates checking nodes to ensure the script has deployed correctly.
# note: Working / Functions
# Green indicates the working of the script. No changes should be made in these groups unless advised.
# note: Variables / Inputs
# Red indicates Variables that can be altered per project and must be set accordingly before running the script.

# group: Important Stuff
# note: Text added using Ctrl+W on your keyboard

# group: Dyn_01_Getting started
# note: Contents
# 1. Firing Dynamo up!
# 2. Dynamo interface
# 3. Searching for nodes
# 	• Manually change node name
# 4. Input nodes
# 5. Watch node
# 6. Grouping nodes
# 	• Standard color code
# 7. Freeze | Preview nodes
# 8. Adding custom Packages into Dynamo
# 	• N:\02 BIM\01_BIM standards\05_resources\03_Dynamo

# group: Input
# note: 1. Interface
# 2. Searching nodes
# 	Update node name
# 3. Add number and update nodes
# 4. Watch node
# 5. Group nodes and color code
# 6. Freeze and Preview nodes!
# 7. Auto vs Manual mode
# 8. Adding Custom packages
x_value = DoubleInput(20)
y_value = DoubleInput(5)
z_value = DoubleInput(1)

# group: Working
byCoordinates = Point.ByCoordinates(x=x_value, y=y_value, z=z_value)

# group: Check output
watch = Watch(byCoordinates)
