# Dynamo graph Dyn_02_Arithmetic and Logic Operators.dyn (Dynamo 2.12.1.8246)

# note: Checking / Outputs
# Orange indicates checking nodes to ensure the script has deployed correctly.
# note: Working / Functions
# Green indicates the working of the script. No changes should be made in these groups unless advised.
# note: Variables / Inputs
# Red indicates Variables that can be altered per project and must be set accordingly before running the script.
# note: Important stuff
# Purple will indicate something important is going on here.

# group: Dyn_02_Arithmetic & Logic Operators
# note: Contents
# 1. Numbers : integer vs float
# 2. Basic Operations
# 3. Trigonometry
# 4. Round (numbers)
# 	• Nearest, Ceiling, Floor
# 5. Sequence | Range
# 	• Remap Values
# 6. Logical operators
# 	• Equal, Greater, Smaller,...
# 7. Boolean
# 	• True or False
# 8. Convert Units
# 9. If Statement

# group: Numbers!
# note: 1. Numbers vs Float
number = DoubleInput(5)

this_is_an_integer = DoubleInput(5)
this_is_a_float = DoubleInput(5.483)

# group: Number | Integer sliders
integer_slider = IntegerSlider(2, range=0..10 step 1)
number_slider = DoubleSlider(0.3798, range=0..1 step 0.3798)

# group: Basic Operations
# note: 2. Basic operations
add = _ + _  # unwired: x, y
sub = _ - _  # unwired: x, y
mul = _ * _  # unwired: x, y
div = _ / _  # unwired: x, y
mod = _ % _  # unwired: x, y

# group: Exponential | Square root
pow = Math.Pow()  # unwired: number, power
sqrt = Math.Sqrt(number=pow)

# group: Trigonometry
sin = Math.Sin()  # unwired: angle
# note: 3. Trigonometry
cos = Math.Cos()  # unwired: angle
tan = Math.Tan()  # unwired: angle
acos = Math.Acos()  # unwired: ratio
asin = Math.Asin()  # unwired: ratio
atan = Math.Atan()  # unwired: ratio

# group: Round nearest
# note: 4. Round
round = Math.Round()  # unwired: number
round_2 = Math.Round()  # unwired: number, digits

# group: Round Up | Down
ceiling = Math.Ceiling()  # unwired: number
floor = Math.Floor()  # unwired: number

# group: Sequence, Remap Range
# note: 5. Sequence | Range
sequence = Sequence()
watch = Watch()  # unwired: arg0
remapRange = Math.RemapRange(numbers=watch)
watch_2 = Watch(remapRange)

# group: Sum
sum = Math.Sum(values=watch_2)
watch_3 = Watch(sum)

# group: Number Range, Average Value
range = Range()
watch_4 = Watch()  # unwired: arg0
average = Math.Average(numbers=watch_4)
watch_5 = Watch(average)

# group: Greater or Less than
gt = _ > _  # unwired: x, y
lt = _ < _  # unwired: x, y

# group: Greather|equal or Less|equal
ge = _ >= _  # unwired: x, y
le = _ <= _  # unwired: x, y

# group: True | False Booleans
# note: 7. Booleans
boolean = BoolSelector(false)
boolean_2 = BoolSelector(true)

# group: Not (inverse boolean)
boolean_3 = BoolSelector(false)
not_ = Not(x=boolean_3)

# group: And (all must be True)
boolean_4 = BoolSelector(true)
boolean_5 = BoolSelector(false)
and_ = And(bool0=boolean_4, bool1=boolean_4, bool2=boolean_4, bool3=boolean_5)

# group: Or (at least one is True)
boolean_6 = BoolSelector(false)
boolean_7 = BoolSelector(true)
or_ = Or(bool0=boolean_6, bool1=boolean_6, bool2=boolean_6, bool3=boolean_7)

# group: XOr (Only One is True)
boolean_8 = BoolSelector(false)
boolean_9 = BoolSelector(true)
xor = Math.Xor(bool=boolean_8, otherBool=boolean_9)

# group: Convert Units
# note: 8. Convert units
convert_between_units = DynamoConvert(MeasurementType="Length", FromConversion="Centimeters", ToConversion="Feet")

# group: Convert Degrees <> Radians
PI = Math.PI()
radiansToDegrees = Math.RadiansToDegrees(radians=PI)
degreesToRadians = Math.DegreesToRadians()  # unwired: degrees

# group: Logic If statement
# note: 9 . If Statement
if_ = RefactoredIf()  # unwired: test, true, false
watch_6 = Watch(if_)

# group: Not Equal | Equal
# note: 6. Logical Operators
ne = _ != _  # unwired: x, y
eq = _ == _  # unwired: x, y

# group: Checking output
watch_7 = Watch()  # unwired: arg0

# group: Check type!
type = Object.Type()  # unwired: object
watch_8 = Watch(type)
