# Dynamo graph Dyn_02_Arithmetic and Logic Operators_sol.dyn (Dynamo 2.12.1.8246)

# note: Checking / Outputs
# Orange indicates checking nodes to ensure the script has deployed correctly.
# note: Important stuff
# Purple will indicate something important is going on here.
# note: Working / Functions
# Green indicates the working of the script. No changes should be made in these groups unless advised.
# note: Variables / Inputs
# Red indicates Variables that can be altered per project and must be set accordingly before running the script.

# group: Dyn_02_Arithmetic & Logic Operators
# note: Contents
# 1. Numbers : integer vs float
# 2. Basic Operations
# 3. Trigonometry
# 4. Round (numbers)
# 	• Nearest, Ceiling, Floor
# 5. Sequence | Range
# 	• Remap Values
# 6. Logical operators
# 	• Equal, Greater, Smaller,...
# 7. Boolean
# 	• True or False
# 8. Convert Units
# 9. If Statement

# group: Numbers!
# note: 1. Numbers vs Float
number = DoubleInput(5)

this_is_an_integer = DoubleInput(5)
this_is_a_float = DoubleInput(5.483)
number_2 = DoubleInput(5)
number_3 = DoubleInput(2)

# group: Basic Operations
# note: 2. Basic operations
add = number_2 + number_3
sub = number_2 - number_3
mul = number_2 * number_3
div = number_2 / number_3
mod = number_2 % number_3

number_4 = DoubleInput(5)
number_5 = DoubleInput(2)

# group: Exponential | Square root
pow = Math.Pow(number=number_4, power=number_5)
sqrt = Math.Sqrt(number=pow)

# note: 3. Trigonometry
number_6 = DoubleInput(45)
number_7 = DoubleInput(0.5)

# group: Trigonometry
sin = Math.Sin(angle=number_6)
cos = Math.Cos(angle=number_6)
tan = Math.Tan(angle=number_6)
acos = Math.Acos(ratio=number_7)
asin = Math.Asin(ratio=number_7)
atan = Math.Atan(ratio=number_7)

# note: 4. Round
number_8 = DoubleInput(1.384)
number_9 = DoubleInput(1.384)
number_10 = DoubleInput(1)

# group: Round nearest
round = Math.Round(number=number_8)
round_2 = Math.Round(number=number_9, digits=number_10)

number_11 = DoubleInput(1.384)

# group: Round Up | Down
ceiling = Math.Ceiling(number=number_11)
floor = Math.Floor(number=number_11)

# note: 5. Sequence | Range
number_12 = DoubleInput(1)
number_13 = DoubleInput(10)
number_14 = DoubleInput(2)
number_15 = DoubleInput(0)
number_16 = DoubleInput(255)

# group: Sequence, Remap Range
sequence = Sequence(start=number_12, amount=number_13, step=number_14)
watch = Watch(sequence)
remapRange = Math.RemapRange(numbers=watch, newMin=number_15, newMax=number_16)
watch_2 = Watch(remapRange)

# group: Sum
sum = Math.Sum(values=watch_2)
watch_3 = Watch(sum)

number_17 = DoubleInput(1)
number_18 = DoubleInput(10)
number_19 = DoubleInput(2)

# group: Number Range, Average Value
range = Range(start=number_17, end=number_18, step=number_19)
watch_4 = Watch(range)
average = Math.Average(numbers=watch_4)
watch_5 = Watch(average)

number_20 = DoubleInput(5)
number_21 = DoubleInput(2)

# group: Greater or Less than
gt = number_20 > number_21
lt = number_20 < number_21

number_22 = DoubleInput(5)
number_23 = DoubleInput(2)

# group: Greather|equal or Less|equal
ge = number_22 >= number_22
le = number_22 <= number_23

# group: True | False Booleans
# note: 7. Booleans
boolean = BoolSelector(false)
boolean_2 = BoolSelector(true)

# group: Not (inverse boolean)
boolean_3 = BoolSelector(false)
not_ = Not(x=boolean_3)

# group: And (all must be True)
boolean_4 = BoolSelector(true)
boolean_5 = BoolSelector(false)
and_ = And(bool0=boolean_4, bool1=boolean_4, bool2=boolean_4, bool3=boolean_5)

# group: Or (at least one is True)
boolean_6 = BoolSelector(false)
boolean_7 = BoolSelector(true)
or_ = Or(bool0=boolean_6, bool1=boolean_6, bool2=boolean_6, bool3=boolean_7)

# group: XOr (Only One is True)
boolean_8 = BoolSelector(false)
boolean_9 = BoolSelector(true)
xor = Math.Xor(bool=boolean_8, otherBool=boolean_9)

# note: 8. Convert units
number_24 = DoubleInput(151)

# group: Convert Units
convert_between_units = DynamoConvert(number_24, MeasurementType="Length", FromConversion="Centimeters", ToConversion="Feet")

# group: Convert Degrees <> Radians
PI = Math.PI()
radiansToDegrees = Math.RadiansToDegrees(radians=PI)
number_25 = DoubleInput(160)
degreesToRadians = Math.DegreesToRadians(degrees=number_25)

# group: Logic If statement
# note: 9 . If Statement
boolean_10 = BoolSelector(false)
number_26 = DoubleInput(5)
number_27 = DoubleInput(10)
if_ = RefactoredIf(test=boolean_10, true=number_26, false=number_27)
watch_6 = Watch(if_)

# note: 6. Logical Operators
number_28 = DoubleInput(5)
number_29 = DoubleInput(2)

# group: Not Equal | Equal
ne = number_28 != number_29
eq = number_28 == number_29

integer = CodeBlock { 5.0; }
float = CodeBlock { 5.483; }
integer_2 = CodeBlock { 5; }

# group: Checking output
watch_7 = Watch()  # unwired: arg0

# group: Number | Integer sliders
number_slider = DoubleSlider(0.3798, range=0..1 step 0.3798)
integer_slider = IntegerSlider(1, range=0..100 step 1)
