# Dynamo graph Dyn_03_Strings and other Data Types.dyn (Dynamo 2.12.1.8246)

# note: Checking / Outputs
# Orange indicates checking nodes to ensure the script has deployed correctly.
# note: Important stuff
# Purple will indicate something important is going on here.
# note: Working / Functions
# Green indicates the working of the script. No changes should be made in these groups unless advised.
# note: Variables / Inputs
# Red indicates Variables that can be altered per project and must be set accordingly before running the script.

# group: Dyn_03_Strings & other Data Types
# note: Contents
# 1. What’s a string?
# 	• Range | Sequence strings
# 	• Strings from other data types String from object. String.ToNumber
# 2. Concatenate | Join Strings
# 3. StartsWith | EndsWith
# 4. Contains
# 5. AllIndicesOf | LastIndexOf | IndexOf
# 6. Lenght | Count
# 7. Change case
# 	• Upper, Lower, ChangeCase
# 8. Insert
# 9. Search and Split
# 	• Replace, Search, Split, Delete, Substring
# 10. Location
# 11. DateTime

# group: String
string = StringInput("String")
string_2 = StringInput("This is a string!")
string_3 = StringInput("1")
string_4 = StringInput("1.52")

# group: String Range | Sequence
range = Range()
watch = Watch(range)
sequence = Sequence()
watch_2 = Watch(sequence)

# group: Strings from other Data Types
code_block = CodeBlock { 1..10..1; }
string_from_array = FromArray(array=code_block)
watch_3 = Watch(string_from_array)
string_from_object = FromObject(object=code_block)
watch_4 = Watch(string_from_object)

toNumber = String.ToNumber(string=watch_4)

# group: Data Types
number = DoubleInput(2)
mul = code_block * number
mul_2 = string_from_object * number

# group: Concatenate | Join Strings
# note: 2. Concatenate | Join
concat = String.Concat()  # unwired: string0, string1, string2
watch_5 = Watch(concat)
join = String.Join()  # unwired: separator, string0, string1, string2
watch_6 = Watch(join)
add = _ + _  # unwired: x, y
watch_7 = Watch(add)

# group: Concatenate | Join Lists
concat_2 = String.Concat()  # unwired: string0
watch_8 = Watch(concat_2)
join_2 = String.Join()  # unwired: separator, string0
watch_9 = Watch(join_2)
join_3 = String.Join()  # unwired: separator, string0, string1, string2
watch_10 = Watch(join_3)

# group: Begin | End
# note: 3. Starts | Ends with
startsWith = String.StartsWith()  # unwired: string, searchFor
watch_11 = Watch(startsWith)
endsWith = String.EndsWith()  # unwired: string, searchFor
watch_12 = Watch(endsWith)

# group: Contains
# note: 4. Contains
list_create = List.Create()  # unwired: item0, item1, item2
contains = String.Contains(string=list_create)  # unwired: searchFor
watch_13 = Watch(contains)

# group: Exact Match
eq = _ == _  # unwired: x, y
watch_14 = Watch(eq)

# group: All | Frist | Last Index
# note: 5. All IndicesOf | LastIndexOf | IndexOf
allIndicesOf = String.AllIndicesOf()  # unwired: string, searchFor
watch_15 = Watch(allIndicesOf)
lastIndexOf = String.LastIndexOf()  # unwired: string, searchFor
watch_16 = Watch(lastIndexOf)
indexOf = String.IndexOf()  # unwired: string, searchFor
watch_17 = Watch(indexOf)

# group: Length | Count
# note: 6. Lenght | Count
length = String.Length()  # unwired: string
watch_18 = Watch(length)
countOccurrences = String.CountOccurrences()  # unwired: string, searchFor
watch_19 = Watch(countOccurrences)

# group: Change Case
# note: 7. Change case
toUpper = String.ToUpper()  # unwired: string
watch_20 = Watch(toUpper)
toLower = String.ToLower()  # unwired: string
watch_21 = Watch(toLower)
changeCase = String.ChangeCase()  # unwired: string, upper
watch_22 = Watch(changeCase)

# group: Insert
# note: 8. Insert
indexOf_2 = String.IndexOf()  # unwired: string, searchFor
add_2 = indexOf_2 + _  # unwired: y
insert = String.Insert(index=add_2)  # unwired: string, toInsert
watch_23 = Watch(insert)

# group: Searching and Separating
# note: 9. Search and Split
replace = String.Replace()  # unwired: string, searchFor, replaceWith
watch_24 = Watch(replace)
split = String.Split()  # unwired: string, separator0
watch_25 = Watch(split)
remove = String.Remove()  # unwired: string, startIndex, count
watch_26 = Watch(remove)
substring = String.Substring()  # unwired: string, startIndex, length
watch_27 = Watch(substring)

# group: Location (User Defined)
# note: 10. Location
number_2 = DoubleInput(45)
string_5 = StringInput("MyLocation")
byLatitudeAndLongitude = DynamoUnits.Location.ByLatitudeAndLongitude(latitude=number_2, longitude=number_2, name=string_5)
name = DynamoUnits.Location.Name(location=byLatitudeAndLongitude)
watch_28 = Watch(name)
latitude = DynamoUnits.Location.Latitude(location=byLatitudeAndLongitude)
watch_29 = Watch(latitude)
longitude = DynamoUnits.Location.Longitude(location=byLatitudeAndLongitude)
watch_30 = Watch(longitude)

# group: Date | Time
# note: 11. DateTime
now = DateTime.Now()
today = DateTime.Today()
isDaylightSavingsTime = DateTime.IsDaylightSavingsTime(dateTime=today)
dayOfWeek = DateTime.DayOfWeek(dateTime=today)
dayOfYear = DateTime.DayOfYear(dateTime=today)
components = DateTime.Components(dateTime=today)
date = DateTime.Date(dateTime=today)

# group: String != Number!
string_6 = StringInput("1")
number_3 = DoubleInput(1)
eq_2 = string_6 == number_3

# group: Check type!
type = Object.Type()  # unwired: object

# note: 1. What's a string?
string_7 = StringInput("")
