# Dynamo graph Dyn_03_Strings and other Data Types_sol.dyn (Dynamo 2.12.1.8246)

# note: Variables / Inputs
# Red indicates Variables that can be altered per project and must be set accordingly before running the script.
# note: Working / Functions
# Green indicates the working of the script. No changes should be made in these groups unless advised.
# note: Checking / Outputs
# Orange indicates checking nodes to ensure the script has deployed correctly.
# note: Important stuff
# Purple will indicate something important is going on here.

# group: Dyn_03_Strings & other Data Types
# note: Contents
# 1. What’s a string?
# 	• Range | Sequence strings
# 	• Strings from other data types String from object. String.ToNumber
# 2. Concatenate | Join Strings
# 3. StartsWith | EndsWith
# 4. Contains
# 5. AllIndicesOf | LastIndexOf | IndexOf
# 6. Lenght | Count
# 7. Change case
# 	• Upper, Lower, ChangeCase
# 8. Insert
# 9. Search and Split
# 	• Replace, Search, Split, Delete, Substring
# 10. Location
# 11. DateTime

# group: String
# note: 1. What's a string?
string = StringInput("String")
string_2 = StringInput("This is a string!")
string_3 = StringInput("1")
string_4 = StringInput("1.52")

# group: Range | Sequence
string_5 = StringInput("A")
string_6 = StringInput("Z")
number = DoubleInput(2)
range = Range(start=string_5, end=string_6, step=number)
watch = Watch(range)
string_7 = StringInput("A")
number_2 = DoubleInput(20)
number_3 = DoubleInput(5)
sequence = Sequence(start=string_7, amount=number_2, step=number_3)
watch_2 = Watch(sequence)

# group: Strings from other Data Types
code_block = CodeBlock { 1..10..1; }
string_from_array = FromArray(array=code_block)
watch_3 = Watch(string_from_array)
string_from_object = FromObject(object=code_block)
watch_4 = Watch(string_from_object)

toNumber = String.ToNumber(string=watch_4)

# group: Data Types
number_4 = DoubleInput(2)
mul = code_block * number_4
mul_2 = string_from_object * number_4

# group: Concatenate | Join Strings
# note: 2. Concatenate | Join
string_8 = StringInput("Concatenate")
string_9 = StringInput("some")
string_10 = StringInput("strings!")
concat = String.Concat(string0=string_8, string1=string_9, string2=string_10)
watch_5 = Watch(concat)
string_11 = StringInput("")
string_12 = StringInput("Join")
string_13 = StringInput("some")
string_14 = StringInput("strings!")
join = String.Join(separator=string_11, string0=string_12, string1=string_13, string2=string_14)
watch_6 = Watch(join)
string_15 = StringInput("Strings can also be ")
string_16 = StringInput("added using +")
add = string_15 + string_16
watch_7 = Watch(add)

# group: Concatenate | Join Lists
code_block_2 = CodeBlock { "a".."z"..1; }
concat_2 = String.Concat(string0=code_block_2)
watch_8 = Watch(concat_2)
string_17 = StringInput(",")
join_2 = String.Join(separator=string_17, string0=code_block_2)
watch_9 = Watch(join_2)
string_18 = StringInput("1")
code_block_3 = CodeBlock { 1..26..1; }
string_from_object_2 = FromObject(object=code_block_3)
join_3 = String.Join(separator=string_17, string0=code_block_2, string1=string_18, string2=string_from_object_2)
watch_10 = Watch(join_3)

# group: Begin | End
string_19 = StringInput("Hello World!")
string_20 = StringInput("hello")
# note: 3. Starts | Ends with
boolean = BoolSelector(true)
startsWith = String.StartsWith(string=string_19, searchFor=string_20, ignoreCase=boolean)
watch_11 = Watch(startsWith)
string_21 = StringInput("World!")
endsWith = String.EndsWith(string=string_19, searchFor=string_21, ignoreCase=boolean)
watch_12 = Watch(endsWith)

# group: Contains
# note: 4. Contains
string_22 = StringInput("John Smith")
string_23 = StringInput("Fred Smithson")
string_24 = StringInput("Joe Biggs")
list_create = List.Create(item0=string_22, item1=string_23, item2=string_24)
string_25 = StringInput("Smith")
boolean_2 = BoolSelector(false)
contains = String.Contains(string=list_create, searchFor=string_25, ignoreCase=boolean_2)
watch_13 = Watch(contains)

# group: Exact Match
string_26 = StringInput("This")
eq = string_26 == string_26
watch_14 = Watch(eq)

# group: All | Frist | Last Index
# note: 5. All IndicesOf | LastIndexOf | IndexOf
string_27 = StringInput("This is a sentence")
string_28 = StringInput("e")
boolean_3 = BoolSelector(true)
allIndicesOf = String.AllIndicesOf(string=string_27, searchFor=string_28, ignoreCase=boolean_3)
watch_15 = Watch(allIndicesOf)
lastIndexOf = String.LastIndexOf(string=string_27, searchFor=string_28, ignoreCase=boolean_3)
watch_16 = Watch(lastIndexOf)
indexOf = String.IndexOf(string=string_27, searchFor=string_28, ignoreCase=boolean_3)
watch_17 = Watch(indexOf)

# group: Length | Count
# note: 6. Lenght | Count
string_29 = StringInput("This is a string")
length = String.Length(string=string_29)
watch_18 = Watch(length)
string_30 = StringInput("is")
boolean_4 = BoolSelector(true)
countOccurrences = String.CountOccurrences(string=string_29, searchFor=string_30, ignoreCase=boolean_4)
watch_19 = Watch(countOccurrences)

# group: Change Case
# note: 7. Change case
string_31 = StringInput("Hello World!")
toUpper = String.ToUpper(string=string_31)
watch_20 = Watch(toUpper)
toLower = String.ToLower(string=string_31)
watch_21 = Watch(toLower)
boolean_5 = BoolSelector(true)
changeCase = String.ChangeCase(string=string_31, upper=boolean_5)
watch_22 = Watch(changeCase)

# group: Insert
# note: 8. Insert
string_32 = StringInput("Here you are, a random string")
string_33 = StringInput("are")
boolean_6 = BoolSelector(true)
indexOf_2 = String.IndexOf(string=string_32, searchFor=string_33, ignoreCase=boolean_6)
number_5 = DoubleInput(3)
add_2 = indexOf_2 + number_5
string_34 = StringInput(" my dear")
insert = String.Insert(string=string_32, index=add_2, toInsert=string_34)
watch_23 = Watch(insert)

# group: Searching and Separating
# note: 9. Search and Split
string_35 = StringInput("A random string")
string_36 = StringInput("string")
string_37 = StringInput("sentence")
replace = String.Replace(string=string_35, searchFor=string_36, replaceWith=string_37)
watch_24 = Watch(replace)
string_38 = StringInput("This is a sentence")
string_39 = StringInput(" ")
split = String.Split(string=string_38, separator0=string_39)
watch_25 = Watch(split)
number_6 = DoubleInput(0)
number_7 = DoubleInput(8)
remove = String.Remove(string=string_38, startIndex=number_6, count=number_7)
watch_26 = Watch(remove)
number_8 = DoubleInput(2)
substring = String.Substring(string=string_38, startIndex=number_8, length=number_8)
watch_27 = Watch(substring)

# group: Location (User Defined)
# note: 10. Location
number_9 = DoubleInput(45)
string_40 = StringInput("MyLocation")
byLatitudeAndLongitude = DynamoUnits.Location.ByLatitudeAndLongitude(latitude=number_9, longitude=number_9, name=string_40)
name = DynamoUnits.Location.Name(location=byLatitudeAndLongitude)
watch_28 = Watch(name)
latitude = DynamoUnits.Location.Latitude(location=byLatitudeAndLongitude)
watch_29 = Watch(latitude)
longitude = DynamoUnits.Location.Longitude(location=byLatitudeAndLongitude)
watch_30 = Watch(longitude)

# group: Date | Time
# note: 11. DateTime
now = DateTime.Now()
today = DateTime.Today()
isDaylightSavingsTime = DateTime.IsDaylightSavingsTime(dateTime=today)
dayOfWeek = DateTime.DayOfWeek(dateTime=today)
dayOfYear = DateTime.DayOfYear(dateTime=today)
components = DateTime.Components(dateTime=today)
date = DateTime.Date(dateTime=today)

# group: String != Number!
string_41 = StringInput("1")
number_10 = DoubleInput(1)
eq_2 = string_41 == number_10

# group: Check type!
type = Object.Type()  # unwired: object
