# Dynamo graph Dyn_04_List Management.dyn (Dynamo 2.12.1.8246)

# note: Important stuff
# Purple will indicate something important is going on here.
# note: Checking / Outputs
# Orange indicates checking nodes to ensure the script has deployed correctly.
# note: Working / Functions
# Green indicates the working of the script. No changes should be made in these groups unless advised.
# note: Variables / Inputs
# Red indicates Variables that can be altered per project and must be set accordingly before running the script.

# group: Dyn_04_List Mgmt
# note: Contents
# 1.Create List
# 2. List Lacing (mgmt)
# 3. List Flatten and Sort
# 	• Lacing + Sort + Extra Sort
# 4. Model element selection query
# 5. BoolMask
# 6. List Cycle | Repeat | Unique items
# 7. List Mix | Max (values)
# 8. List IndexOf
# 9. Remap Range!
# 10. List Shuffle | Reverse
# 11. List Join | Create
# 12. List Transpose!
# 13. List Flatten | Chop list
# 14. Take | Drop EveryNthItem
# 15. List Count @ level
# 16. List Get item at index (@level)
# 14. List.Map??
# 15. List ReplaceItemAtIndex
# 16. List Lacing (Auto, Shortest, Longest, Cross)
# Practical example!
# 	• Extract total area of each wall type? (List.GroupByKey)

# group: Revit file!
# note: Use this file in combination with the following Revit file:
# Dyn_04_07_10_11_Training file.rvt

# group: Reading some values
string = StringInput("Area")
string_2 = StringInput("Type")

# group: Min | Max
# note: 4. Mix | Max values
maximumItem = List.MaximumItem()  # unwired: list
minimumItem = List.MinimumItem()  # unwired: list

# group: Index of
# note: 5. IndexOf
indexOf = List.IndexOf()  # unwired: list, element

# group: Remap Range
# note: 6. Remap Range
remapRange = Math.RemapRange()  # unwired: numbers

# group: List of Lists
# note: 8. Join Lists
join = List.Join()  # unwired: list0, list1
list_create = List.Create()  # unwired: item0, item1, item2

# group: Cycle | Repeat
cycle = List.Cycle()  # unwired: list, amount
# note: 3. Cycle | Repeat
ofRepeatedItem = List.OfRepeatedItem()  # unwired: item, amount
watch = Watch(ofRepeatedItem)

# group: Unique
uniqueItems = List.UniqueItems(list=watch)

# group: Transpose
# note: 9. Transpose List
transpose = List.Transpose()  # unwired: lists

# group: Reverse | Shuffle
reverse = List.Reverse()  # unwired: list
# note: 7. Shuffle | Reverse
shuffle = List.Shuffle()  # unwired: list

# group: Flatten | Chop
# note: 10. Flatten | Chop
integer_slider = IntegerSlider(1, range=0..3 step 1)
flatten = List.Flatten(amount=integer_slider)  # unwired: list
integer_slider_2 = IntegerSlider(2, range=0..3 step 1)
chop = List.Chop(list=flatten, lengths=integer_slider_2)

# group: Take | Drop
# note: 11. Take | Drop Items
takeEveryNthItem = List.TakeEveryNthItem()  # unwired: list, n
dropEveryNthItem = List.DropEveryNthItem()  # unwired: list, n

# group: Count @ Level
# note: 12. Count@Level
count = List.Count()  # unwired: list
count_2 = List.Count()  # unwired: list
count_3 = List.Count()  # unwired: list

# group: Get at Index@level
# note: 13. ItemAtIndex@Level
code_block = CodeBlock { 0; }
getItemAtIndex = List.GetItemAtIndex(index=code_block)  # unwired: list
getItemAtIndex_2 = List.GetItemAtIndex(index=code_block)  # unwired: list
getItemAtIndex_3 = List.GetItemAtIndex(index=code_block)  # unwired: list

# group: List Map
# note: Map will aply a function to each list (or sublist)
# note: 14. List.Map
code_block_2 = CodeBlock { 0; }
getItemAtIndex_4 = List.GetItemAtIndex(index=code_block_2)  # unwired: list
map = List.Map(function=getItemAtIndex_4)  # unwired: list
code_block_3 = CodeBlock { 0; 5; }
replaceItemAtIndex = List.ReplaceItemAtIndex(index=code_block_3.out0, item=code_block_3.out1)  # unwired: list
map_2 = List.Map(function=replaceItemAtIndex)  # unwired: list

# group: Practical example
# note: Total area of each wall type?
filterByBoolMask = List.FilterByBoolMask()  # unwired: list, mask

id = Element.Id()  # unwired: element
groupByKey = List.GroupByKey(keys=id)  # unwired: list
watch_2 = Watch(groupByKey.groups)

# group: Sum
sum = Math.Sum(values=watch_2)

# group: List Lacing
# note: 15. List Lacing
code_block_4 = CodeBlock { 1..10..1; }
code_block_5 = CodeBlock { "a".."z"..1; }
add = code_block_4 + code_block_5
add_2 = code_block_4 + code_block_5  # lacing=Shortest
add_3 = code_block_4 + code_block_5  # lacing=Longest
add_4 = code_block_4 + code_block_5  # lacing=CrossProduct

# group: Bool Masks
# note: 2. Bool Mask
gt = _ > _  # unwired: x, y
filterByBoolMask_2 = List.FilterByBoolMask(mask=gt)  # unwired: list
watch_3 = Watch(filterByBoolMask_2.in)

# group: Getting all walls
# note: 1. Getting all walls
categories = Categories("OST_Walls")

code_block_6 = CodeBlock { ["Name1","Name2","Name3"]; [3,2,1]; }

# group: Extra Sort
sortByFunction = List.SortByFunction()  # unwired: list, sortFunction
sortIndexByValue = List.SortIndexByValue()  # unwired: list
sortByKey = List.SortByKey(list=code_block_6.out0, keys=code_block_6.out1)

# note: Lacing Example
points = CodeBlock { p1 = 0..10..1; p2 = 0..5..1; Point.ByCoordinates(p1,0,0); Point.ByCoordinates(p2,0,2); }

# group: Lacing (List Mgmt)
byStartPointEndPoint = Line.ByStartPointEndPoint(startPoint=points.out2, endPoint=points.out3, lacing=CrossProduct)
byStartPointEndPoint_2 = Line.ByStartPointEndPoint(startPoint=points.out2, endPoint=points.out3, lacing=Longest)
byStartPointEndPoint_3 = Line.ByStartPointEndPoint(startPoint=points.out2, endPoint=points.out3)

# group: Sort By Key (lenght)
flatten_2 = List.Flatten(list=byStartPointEndPoint)
length = Curve.Length(curve=flatten_2)
sortByKey_2 = List.SortByKey(list=flatten_2, keys=length)

# group: Lacing Mgmt (Auto, Longest, Cross)
# note: List Lacing
code_block_7 = CodeBlock { [2,3]; [6,4,10]; }
mul = code_block_7.out0 * code_block_7.out1  # lacing=CrossProduct
mul_2 = code_block_7.out0 * code_block_7.out1  # lacing=Longest
mul_3 = code_block_7.out0 * code_block_7.out1

# group: Flatten and Sort
sort = List.Sort(list=mul)
# note: List flatten and Sort
flatten_3 = List.Flatten(list=mul)
sort_2 = List.Sort(list=flatten_3)

# group: Create List
# note: Creating a list
list_create_2 = List.Create()  # unwired: item0, item1
list_create_3 = List.Create()  # unwired: item0, item1
code_block_8 = CodeBlock {  }
code_block_9 = CodeBlock {  }
