# Dynamo graph Dyn_04_List Management_sol.dyn (Dynamo 2.12.1.8246)

# note: Variables / Inputs
# Red indicates Variables that can be altered per project and must be set accordingly before running the script.
# note: Working / Functions
# Green indicates the working of the script. No changes should be made in these groups unless advised.
# note: Checking / Outputs
# Orange indicates checking nodes to ensure the script has deployed correctly.
# note: Important stuff
# Purple will indicate something important is going on here.

# group: Revit file!
# note: Use this file in combination with the following Revit file:
# Dyn_04_07_10_11_Training file.rvt

# group: Dyn_04_List Mgmt
# note: Contents
# 1.Create List
# 2. List Lacing (mgmt)
# 3. List Flatten and Sort
# 	• Lacing + Sort + Extra Sort
# 4. Model element selection query
# 5. BoolMask
# 6. List Cycle | Repeat | Unique items
# 7. List Mix | Max (values)
# 8. List IndexOf
# 9. Remap Range!
# 10. List Shuffle | Reverse
# 11. List Join | Create
# 12. List Transpose!
# 13. List Flatten | Chop list
# 14. Take | Drop EveryNthItem
# 15. List Count @ level
# 16. List Get item at index (@level)
# 14. List.Map??
# 15. List ReplaceItemAtIndex
# 16. List Lacing (Auto, Shortest, Longest, Cross)
# Practical example!
# 	• Extract total area of each wall type? (List.GroupByKey)

# group: Getting all walls
# note: 1. Getting all walls
categories = Categories("OST_Walls")
all_elements_of_category = ElementsOfCategory(Category=categories)

# group: Reading some values
string = StringInput("Area")
getParameterValueByName = Element.GetParameterValueByName(element=all_elements_of_category, parameterName=string)
string_2 = StringInput("Type")
getParameterValueByName_2 = Element.GetParameterValueByName(element=all_elements_of_category, parameterName=string_2)

watch = Watch(getParameterValueByName)

# group: Min | Max
minimumItem = List.MinimumItem(list=watch)
# note: 4. Mix | Max values
maximumItem = List.MaximumItem(list=watch)

# group: Index of
indexOf = List.IndexOf(list=watch, element=maximumItem)

# group: Remap Range
# note: 5. IndexOf
# note: 6. Remap Range
code_block = CodeBlock { 0; 1; }
remapRange = Math.RemapRange(numbers=watch, newMin=code_block.out0, newMax=code_block.out1)

watch_2 = Watch(all_elements_of_category)

# group: Cycle | Repeat
code_block_2 = CodeBlock { 3; }
cycle = List.Cycle(list=watch, amount=code_block_2)
# note: 3. Cycle | Repeat
code_block_3 = CodeBlock { 500; 50; }
ofRepeatedItem = List.OfRepeatedItem(item=code_block_3.out0, amount=code_block_3.out1)
watch_3 = Watch(ofRepeatedItem)

# group: Unique
uniqueItems = List.UniqueItems(list=watch_3)

# group: Reverse | Shuffle
reverse = List.Reverse(list=watch)
# note: 7. Shuffle | Reverse
shuffle = List.Shuffle(list=watch)

watch_4 = Watch(getParameterValueByName_2)

# group: List of Lists
# note: 8. Join Lists
join = List.Join(list0=watch, list1=watch_2)
list_create = List.Create(item0=watch, item1=watch_2, item2=watch_4)

# group: Transpose
# note: 9. Transpose List
transpose = List.Transpose(lists=list_create)

# group: Flatten | Chop
# note: 10. Flatten | Chop
integer_slider = IntegerSlider(1, range=0..3 step 1)
flatten = List.Flatten(list=transpose, amount=integer_slider)
integer_slider_2 = IntegerSlider(2, range=0..3 step 1)
chop = List.Chop(list=flatten, lengths=integer_slider_2)

# group: Take | Drop
# note: 11. Take | Drop Items
code_block_4 = CodeBlock { 3; 0; }
takeEveryNthItem = List.TakeEveryNthItem(list=flatten, n=code_block_4.out0, offset=code_block_4.out1)
dropEveryNthItem = List.DropEveryNthItem(list=flatten, n=code_block_4.out0, offset=code_block_4.out1)

# group: Count @ Level
# note: 12. Count@Level
count = List.Count(list=chop)
count_2 = List.Count(list=chop@L1)
count_3 = List.Count(list=chop@L2)

# group: Get at Index@level
# note: 13. ItemAtIndex@Level
code_block_5 = CodeBlock { 0; }
getItemAtIndex = List.GetItemAtIndex(list=chop, index=code_block_5)
getItemAtIndex_2 = List.GetItemAtIndex(list=chop@L1, index=code_block_5)
getItemAtIndex_3 = List.GetItemAtIndex(list=chop@L2, index=code_block_5)

# group: List Map
# note: Map will aply a function to each list (or sublist)
# note: 14. List.Map
code_block_6 = CodeBlock { 0; }
getItemAtIndex_4 = List.GetItemAtIndex(index=code_block_6)  # unwired: list
map = List.Map(list=chop, function=getItemAtIndex_4)
code_block_7 = CodeBlock { 0; 5; }
replaceItemAtIndex = List.ReplaceItemAtIndex(index=code_block_7.out0, item=code_block_7.out1)  # unwired: list
map_2 = List.Map(list=chop, function=replaceItemAtIndex)

# group: Practical example
# note: Total area of each wall type?
filterByBoolMask = List.FilterByBoolMask()  # unwired: list, mask

id = Element.Id(element=watch_4)
groupByKey = List.GroupByKey(list=watch, keys=id)
watch_5 = Watch(groupByKey.groups)

# group: Sum
sum = Math.Sum(values=watch_5)

# group: List Lacing
# note: 15. List Lacing
code_block_8 = CodeBlock { 1..10..1; }
code_block_9 = CodeBlock { "a".."z"..1; }
add = code_block_8 + code_block_9
add_2 = code_block_8 + code_block_9  # lacing=Shortest
add_3 = code_block_8 + code_block_9  # lacing=Longest
add_4 = code_block_8 + code_block_9  # lacing=CrossProduct

# group: Bool Masks
# note: 2. Bool Mask
number = DoubleInput(100)
gt = watch > number
filterByBoolMask_2 = List.FilterByBoolMask(list=watch_2, mask=gt)
watch_6 = Watch(filterByBoolMask_2.in)

code_block_10 = CodeBlock { ["Name1","Name2","Name3"]; [3,2,1]; }

# group: Extra Sort
sortByFunction = List.SortByFunction()  # unwired: list, sortFunction
sortIndexByValue = List.SortIndexByValue()  # unwired: list
sortByKey = List.SortByKey(list=code_block_10.out0, keys=code_block_10.out1)

# group: Lacing Mgmt (Auto, Longest, Cross)
# note: List Lacing
code_block_11 = CodeBlock { [2,3]; [6,4,10]; }
# note: 2x6	3x6
# 2x4	3x4
# 2x10	3x10
mul = code_block_11.out0 * code_block_11.out1  # lacing=CrossProduct
# note: 2x6
# 3x4
mul_2 = code_block_11.out0 * code_block_11.out1
# note: 2x6
# 3x4
# 3x10
mul_3 = code_block_11.out0 * code_block_11.out1  # lacing=Longest

# group: Flatten and Sort
sort = List.Sort(list=mul)
# note: List flatten and Sort
flatten_2 = List.Flatten(list=mul)
sort_2 = List.Sort(list=flatten_2)

# note: Lacing Example
points = CodeBlock { p1 = 0..10..1; p2 = 0..5..1; Point.ByCoordinates(p1,0,0); Point.ByCoordinates(p2,0,2); }

# group: Lacing (List Mgmt)
byStartPointEndPoint = Line.ByStartPointEndPoint(startPoint=points.out2, endPoint=points.out3, lacing=CrossProduct)
byStartPointEndPoint_2 = Line.ByStartPointEndPoint(startPoint=points.out2, endPoint=points.out3, lacing=Longest)
byStartPointEndPoint_3 = Line.ByStartPointEndPoint(startPoint=points.out2, endPoint=points.out3)

# group: Sort By Key (lenght)
flatten_3 = List.Flatten(list=byStartPointEndPoint)
length = Curve.Length(curve=flatten_3)
sortByKey_2 = List.SortByKey(list=flatten_3, keys=length)

# group: Create List
# note: Creating a list
code_block_12 = CodeBlock { 2; 3; }
list_create_2 = List.Create(item0=code_block_12.out0, item1=code_block_12.out1)
code_block_13 = CodeBlock { "Eternal"; "Sunshine"; "of"; "the"; "Spotless"; "Mind"; }
list_create_3 = List.Create(item0=code_block_13.out0, item1=code_block_13.out1, item2=code_block_13.out2, item3=code_block_13.out3, item4=code_block_13.out4, item5=code_block_13.out5)
code_block_14 = CodeBlock()
# ---------- code_block_14.designscript (7 lines) ----------
[
"Eternal",
"Sunshine",
"of",
"the",
"Spotless",
"Mind"];
# ----------------------------------------
code_block_15 = CodeBlock { [2,3]; }
