# Dynamo graph Dyn_05_List Management_Example.dyn (Dynamo 2.12.1.8246)

# note: Checking / Outputs
# Orange indicates checking nodes to ensure the script has deployed correctly.
# note: Important stuff
# Purple will indicate something important is going on here.
# note: Working / Functions
# Green indicates the working of the script. No changes should be made in these groups unless advised.
# note: Variables / Inputs
# Red indicates Variables that can be altered per project and must be set accordingly before running the script.

# group: Dyn_05_List Mgmt_Example
# note: Exercise & Hints
# We want to establish a codification language. This will be based on the following data:
# 1. A-Z standard alphabet values and any extra special character (? ! , : ; .)
# 2. A two digits random number sequence starting at 10.
# 	Use List.Shuffle to randomize your values! (Random will not work on integer)
# A. Code the following Sentece using Random Seed=1
# • All work and no play makes Jack a dull boy
# B. Decode the following messages using Random Seed=3
# •19151537271915271035271929353723141812
# •221628272629272829142722152320273716233727363714391026273314353528273614103725
# •1535303810361627192937161520131424181520172726292728291427363915231827103725

# group: A. Coding String
string_to_code = CodeBlock { "All work and no play makes Jack a dull boy"; }

# group: B. Decoding Strings
string_to_code_2 = CodeBlock()
# ---------- string_to_code_2.designscript (8 lines) ----------
//String 1
"19151537271915271035271929353723141812";

//String 2
"221628272629272829142722152320273716233727363714391026273314353528273614103725";

//String 3
"1535303810361627192937161520131424181520172726292728291427363915231827103725";
# ----------------------------------------
