# Dynamo graph Dyn_05_List Management_Example_sol.dyn (Dynamo 2.12.1.8246)

# note: Checking / Outputs
# Orange indicates checking nodes to ensure the script has deployed correctly.
# note: Important stuff
# Purple will indicate something important is going on here.
# note: Working / Functions
# Green indicates the working of the script. No changes should be made in these groups unless advised.
# note: Variables / Inputs
# Red indicates Variables that can be altered per project and must be set accordingly before running the script.

# group: Dyn_05_List Mgmt_Example
# note: Exercise & Hints
# We want to establish a codification language. This will be based on the following data:
# 1. A-Z standard alphabet values and any extra special character (? ! , : ; .)
# 2. A two digits random number sequence starting at 10.
# 	Use List.Shuffle to randomize your values! (Random will not work on integer)
# A. Code the following Sentece using Random Seed=1
# • All work and no play makes Jack a dull boy
# B. Decode the following messages using Random Seed=3
# •19151537271915271035271929353723141812
# •221628272629272829142722152320273716233727363714391026273314353528273614103725
# •1535303810361627192937161520131424181520172726292728291427363915231827103725
# note: Workflow
# A. Code
# 1. Create Range | Sequence (Strings and Numbers)
# 2. List Shuffle (Random Seed 1)
# 3. Split String (get individual characters)
# 4. Find Indices Of each character
# 5. List Item At Index on numbers values
# 6. Concat!
# B. Decode
# 1. Chop the list evey 2 values
# 2. List.Map and concatenate sublists
# 3. Find number indices on list
# 4. Get item at index on Characters list
# 5. Concat them!

# group: 1. Create all characters
special_characters = CodeBlock()
# ---------- special_characters.designscript (6 lines) ----------
[" ",
"!",
"?",
",",
";
"];
# ----------------------------------------
code_block = CodeBlock { "A"; "Z"; 1; }
range = Range(start=code_block.out0, end=code_block.out1, step=code_block.out2)
addItemToEnd = List.AddItemToEnd(item=special_characters, list=range)
flatten = List.Flatten(list=addItemToEnd)

# group: 2. Number sequence
code_block_2 = CodeBlock { 10; 1; }
count = List.Count(list=flatten)
sequence = Sequence(start=code_block_2.out0, amount=count, step=code_block_2.out1)

# group: 3. Randomize numbers
seed = CodeBlock { 3; }
shuffle = List.Shuffle(list=sequence, seed=seed)

watch = Watch(shuffle)
watch_2 = Watch(flatten)

# group: 4. String to code
code_block_3 = CodeBlock { "All work and no play makes Jack a dull boy"; }

# group: 5. Split string into single characters
toUpper = String.ToUpper(string=code_block_3)
string = StringInput("")
split = String.Split(string=toUpper, separator0=string)

# group: 6. Getting Character and then selecting number
indexOf = List.IndexOf(list=watch_2, element=split)
getItemAtIndex = List.GetItemAtIndex(list=watch, index=indexOf)

# group: 7. Convert numbers to string and join them
string_from_object = FromObject(object=getItemAtIndex)
concat = String.Concat(string0=string_from_object)

watch_3 = Watch(concat)

# group: Strings to decode!
decode_the_following_messages = CodeBlock()
# ---------- decode_the_following_messages.designscript (3 lines) ----------
"19151537271915271035271929353723141812";
"221628272629272829142722152320273716233727363714391026273314353528273614103725";
"1535303810361627192937161520131424181520172726292728291427363915231827103725";
# ----------------------------------------

# group: Split the strig into individual numbers
string_from_object_2 = FromObject(object=decode_the_following_messages.out2)
string_2 = StringInput("")
split_2 = String.Split(string=string_from_object_2, separator0=string_2)

# group: Chop into 2 items lists
code_block_4 = CodeBlock { 2; }
chop = List.Chop(list=split_2, lengths=code_block_4)

# group: Concat characters on each sublist
concat_2 = String.Concat()  # unwired: string0
map = List.Map(list=chop, function=concat_2)

# group: Flatten!
flatten_2 = List.Flatten(list=map)

# group: Convert number into string and List index
string_from_object_3 = FromObject(object=watch)
indexOf_2 = List.IndexOf(list=string_from_object_3, element=flatten_2)

# group: Getting characters based on index
getItemAtIndex_2 = List.GetItemAtIndex(list=watch_2, index=indexOf_2)

# group: Concat!
concat_3 = String.Concat(string0=getItemAtIndex_2)

watch_4 = Watch(concat_3)
range_2 = CodeBlock { "A".."Z"..1; }
sequence_2 = CodeBlock { 10..#nr..1; }  # unwired: nr
