# Dynamo graph Dyn_06_DesignScript and Code Block.dyn (Dynamo 2.12.1.8246)

# note: Important stuff
# Purple will indicate something important is going on here.
# note: Checking / Outputs
# Orange indicates checking nodes to ensure the script has deployed correctly.
# note: Working / Functions
# Green indicates the working of the script. No changes should be made in these groups unless advised.
# note: Variables / Inputs
# Red indicates Variables that can be altered per project and must be set accordingly before running the script.

# group: Dyn_06_DesignScript and Code Block
# note: Contents
# 1. Codeblock (accepting all kind of Data)
# 2. Statements in CodeBlock
# 	• Implied Statements (no input needed)
# 	• Statements (input, multiline)
# 3. Booleans in CodeBlock
# 4. NodeToCode
# 	• Point.ByCoordinates(x,y,z)
# 	• Inputs + Points (single and lists)
# 5. Range function (CodeBlock vs DesignScript)
# 6. Sequence function (CodeBlock vs DesignScript)
# 7. Complex example:
# 	• Range, Picking an item from list, transpose
# 8. Lists in Codeblock [1,2,3]
# 9. Dicitionaries {key:value}
# 10. Functions
#  	def name(input)
# 	{
# 	return =  value
# 	}

# group: Code Blocks
# note: It accepts all kind of types
# note: 1. Code Block
code_block = CodeBlock { 2; }
code_block_2 = CodeBlock { 1.0; }
code_block_3 = CodeBlock { "String"; }
code_block_4 = CodeBlock { true; }
code_block_5 = CodeBlock { false; }
code_block_6 = CodeBlock { 2; 1.0; "String"; true; false; }

# group: Implied statements
# note: 2. Statements in Code block
code_block_7 = CodeBlock { x=5; }
code_block_8 = CodeBlock { 2+2; }

# group: Checking output
watch = Watch()  # unwired: arg0

# note: can feed a list!
code_block_9 = CodeBlock { [1,3]; }
code_block_10 = CodeBlock { 1; 2; }
code_block_11 = CodeBlock { 1; 2; }

# group: Statments
code_block_12 = CodeBlock(x=code_block_9) { x+5; }
code_block_13 = CodeBlock(x=code_block_10.out0, y=code_block_10.out1) { x+y; }
code_block_14 = CodeBlock(x=code_block_11.out0, y=code_block_11.out1) { x; x+y; x*y; x-y; }

# group: Node to Code
# note: 4. Node to Code
code_block_15 = CodeBlock { 5; }
byCoordinates = Point.ByCoordinates(x=code_block_15, y=code_block_15, z=code_block_15)

# group: Range
# note: 5. Range
code_block_16 = CodeBlock { 1; 10; }
# note: start,stop,step
range = Range(start=code_block_16.out0, end=code_block_16.out1, step=code_block_16.out0)

# group: Sequence
# note: 6. Sequence
code_block_17 = CodeBlock { 1; 10; }
sequence = Sequence(start=code_block_17.out0, amount=code_block_17.out1, step=code_block_17.out0)

# group: Complex example
# note: 7. Complex example
code_block_18 = CodeBlock { 1; 10; }
range_2 = Range(start=code_block_18.out0, end=code_block_18.out1, step=code_block_18.out0)
code_block_19 = CodeBlock { 5; }
getItemAtIndex = List.GetItemAtIndex(list=range_2, index=code_block_19)
transpose = List.Transpose(lists=getItemAtIndex)

# group: Create Lists
code_block_20 = CodeBlock { str1="st1"; str2="st2"; str3="st3"; [str1,str2,str3]; }
# note: 8. Lists
code_block_21 = CodeBlock { []; }

# group: Functions
# note: 10. Functions
code_block_22 = CodeBlock()
# ---------- code_block_22.designscript (5 lines) ----------
def squared(input)
{
//explanantion text
return input*input;
};
# ----------------------------------------
code_block_23 = CodeBlock { 5; }
code_block_24 = CodeBlock(x=code_block_23) { squared(x); }

# group: Inputs + Point
point = CodeBlock { x_val; y_val; z_val; }  # unwired: x_val, y_val, z_val
point_2 = CodeBlock { input; }  # unwired: input

# group: Dictionaries
# note: 9. Dictionary
code_block_25 = CodeBlock()
# ---------- code_block_25.designscript (5 lines) ----------
{
"key1":"value1",
"key2":"value2",
"key3":"value3"
};
# ----------------------------------------
keys = DesignScript.Builtin.Dictionary.Keys(dictionary=code_block_25)
values = DesignScript.Builtin.Dictionary.Values(dictionary=code_block_25)
code_block_26 = CodeBlock { "key1"; }
valueAtKey = DesignScript.Builtin.Dictionary.ValueAtKey(dictionary=code_block_25, key=code_block_26)

# group: Get item at index
code_block_27 = CodeBlock(mylist=code_block_21) { mylist[]; }
code_block_28 = CodeBlock(list=code_block_21) { list[..]; }

# group: Concatenate Strings
code_block_29 = CodeBlock { "supercalifragilistic"+"expialidocious"; }
watch_2 = Watch(code_block_29)
code_block_30 = CodeBlock { "know"; "how"; }
code_block_31 = CodeBlock(string1=code_block_30.out0, string2=code_block_30.out1) { string1 + "-" + string2; }
watch_3 = Watch(code_block_31)

# group: Conditional Statement
# note: expression to evaluate ? result if true :  result if false
conditional_statement = CodeBlock()
# ---------- conditional_statement.designscript (2 lines) ----------
//expression to eval ? true : false
2+2==4 ? 20:10;
# ----------------------------------------
code_block_32 = CodeBlock { 2; }
add = code_block_32 + code_block_32
code_block_33 = CodeBlock { 4; }
eq = add == code_block_33
code_block_34 = CodeBlock { 20; 10; }
if_ = RefactoredIf(test=eq, true=code_block_34.out0, false=code_block_34.out1)

# group: Advanced Range | Sequence
code_block_35 = CodeBlock()
# ---------- code_block_35.designscript (5 lines) ----------
//Sequence
0..#10..(1..3);

//Range
0..10..(1..3);
# ----------------------------------------
code_block_36 = CodeBlock()
# ---------- code_block_36.designscript (5 lines) ----------
//Range
(0..1)..10..2;

//Range
(0..1)..10..(2..3);
# ----------------------------------------
code_block_37 = CodeBlock()
# ---------- code_block_37.designscript (5 lines) ----------
//Equal Divisions
0..(1..3)..#3;

//Range
0..(2..5)..1;
# ----------------------------------------
code_block_38 = CodeBlock()
# ---------- code_block_38.designscript (5 lines) ----------
// Sequence
(0..1)..#5..(2..3);

// Range
(0..1)..5..(2..3);
# ----------------------------------------

watch_4 = Watch(code_block_28)
# note: 3. Booleans
code_block_39 = CodeBlock { 5; }

# group: Booleans
code_block_40 = CodeBlock(x=code_block_39) { x==5; x!=5; x>5; x<5; x>=5; x<=5; }

watch_5 = Watch(code_block_40.out0)

# group: List in a list
code_block_41 = CodeBlock { List.GetItemAtIndex(list<2>,2); }  # unwired: list
code_block_42 = CodeBlock { list[0][1..2]; }  # unwired: list
code_block_43 = CodeBlock { list[0][-1]; }  # unwired: list
code_block_44 = CodeBlock()
# ---------- code_block_44.designscript (6 lines) ----------
title= ["Mullholland Drive","Boyhood","Lost in Translation","No Country for Old Men"];
director= ["David Lynch","Richard Linklater","Sofia Coppola","Ethan Coen"];
year= [2002,2014,2003,2008];

//Create a list!
movies = [title, director, year];
# ----------------------------------------
code_block_45 = CodeBlock { list[1]; }  # unwired: list
