# Dynamo graph Dyn_07_Working with Revit Data_sol.dyn (Dynamo 2.12.1.8246)

# note: Important stuff
# Purple will indicate something important is going on here.
# note: Checking / Outputs
# Orange indicates checking nodes to ensure the script has deployed correctly.
# note: Working / Functions
# Green indicates the working of the script. No changes should be made in these groups unless advised.
# note: Variables / Inputs
# Red indicates Variables that can be altered per project and must be set accordingly before running the script.

# group: Dyn_07_Working with Revit Data
# note: Contents
# 1. Element Collectors
# 	• Categories, Element Types, Family Types, Elements in Active View
# 2. Better Collectors
# 	• CodeBlock + Category.ByName
# 	• ElementQueries.
# 3. Get Specials
# 	• Levels, Revision, Phase
# 4. Collector Manual
# 	• Pick Model element(s)
# 5. Specify Element
# 	• Sheet, Views, Levels
# 6. Collecting Rooms
# 	• Room.Area, Room.Number, Room.Name,...
# 7. Set Room Data
# 	• Element.SetParameterValueByName
# 8. Get All project Walls
# 	• Element vs Element.ElementType
# 	• Parameter.ParameterType, Parameter.Value, Parameter.IsShared
# 9. Element.ID vs UniqueID
# 10. Element.GetLocation
# 11. Element Data
# 	• Element.Geometry, Element.Name, Element.GetCategory
# 12. Get | Set Data (Type vs Instance!)
# 	• Element.GetParameterValueByName
# 	• Element.SetParameterValueByName
# 13. Examples
# 		- Add into comments “Element placed at: {elevation}mm
# 		- Add into TypeMark: WA.{sequence}

# group: Revit file!
# note: Use this file in combination with the following Revit file:
# Dyn_04_07_10_11_Training file.rvt

# group: Element Collectors
categories = Categories("OST_Walls")
all_elements_of_category = ElementsOfCategory(Category=categories)
element_types = ElementTypes("FloorType")
all_elements_of_type = ElementsOfType(element_type=element_types)
# note: 1. Element Collector
family_types = FamilyTypes("Bar Chair:Bar Chair")
all_elements_of_family_type = ElementsOfFamilyType(Family_Type=family_types)
all_elements_in_active_view = ElementsInView()

# group: Checking output
watch = Watch()  # unwired: arg0

# group: Collectors (better)
# note: 2. Collectors (better)
code_block = CodeBlock { "Walls"; }
byName = Category.ByName(name=code_block)
code_block_2 = CodeBlock { "Bar Chair"; }
byName_2 = FamilyType.ByName(name=code_block_2)

# group: Collect Rooms
# note: 6. Collecting Model Rooms
categories_2 = Categories("OST_Rooms")
all_elements_of_category_2 = ElementsOfCategory(Category=categories_2)
code_block_3 = CodeBlock { Category.ByName("Rooms"); }

# group: Get Room data
name = Room.Name(room=all_elements_of_category_2)
area = Room.Area(room=all_elements_of_category_2)
number = Room.Number()  # unwired: room
height = Room.Height()  # unwired: room
volume = Room.Volume()  # unwired: room
setName = Room.SetName()  # unwired: room, value
setNumber = Room.SetNumber()  # unwired: room, value

# group: Get Special
select_revision = RevitRevisions("Seq. 1 - Revision 1")
# note: 3. Collector (specials)
levels = Levels("Level 1")
select_phase = RevitPhases("Learning Content")

# group: Collector (manual)
# note: 4. Collector (manual)
select_model_element = DSModelElementSelection()  # nothing selected
select_model_elements = DSModelElementsSelection()  # nothing selected

# group: Views (all types of views)
views = Views("D_1000_site plan_scale 1-XXX")

# group: Sheets
# note: 5. Specify element
sheets = Sheets("Plans")
sheetName = Sheet.SheetName(sheet=sheets)
sheetNumber = Sheet.SheetNumber(sheet=sheets)

# group: Levels
levels_2 = Levels("Level 1")

# group: Example: Filtering elements on level
all_elements_at_level = ElementsAtLevel(Level=levels_2)
getCategory = Element.GetCategory(element=all_elements_at_level)
string_from_object = FromObject(object=getCategory)
code_block_4 = CodeBlock { "Walls"; }
eq = string_from_object == code_block_4
filterByBoolMask = List.FilterByBoolMask(list=all_elements_at_level, mask=eq)
watch_2 = Watch(filterByBoolMask.in)

# group: Get project walls
# note: 8. Collect Project Walls
code_block_5 = CodeBlock { "Walls"; }
byName_3 = Category.ByName(name=code_block_5)
all_elements_of_category_3 = ElementsOfCategory(Category=byName_3)
code_block_6 = CodeBlock { cat = "Walls"; cat_selector = Category.ByName(cat); ElementQueries.OfCategory(cat_selector); }

# group: Parameters (Instance)
parameters = Element.Parameters(element=all_elements_of_category_3)
parameterType = Parameter.ParameterType(parameter=parameters)
value = Parameter.Value(parameter=parameters)
isShared = Parameter.IsShared(parameter=parameters)

# group: Element ID's
id = Element.Id(element=all_elements_of_category_3)
# note: ID is the Revit
# Unique ID is the hardcoded one
uniqueId = Element.UniqueId(element=all_elements_of_category_3)

# group: Element location
getLocation = Element.GetLocation(element=all_elements_of_category_3)
setLocation = Element.SetLocation()  # unwired: element, geometry

# group: Element Data
geometry = Element.Geometry(element=all_elements_of_category_3)
name_2 = Element.Name(element=all_elements_of_category_3)
getCategory_2 = Element.GetCategory(element=all_elements_of_category_3)
elementType = Element.ElementType(element=all_elements_of_category_3)

# group: Get | Set Data
code_block_7 = CodeBlock { "Comments"; }
setParameterByName = Element.SetParameterByName(element=all_elements_of_category_3, parameterName=code_block_7)  # frozen; unwired: value
code_block_8 = CodeBlock { "Element placed at: "; " mm"; }
code_block_9 = CodeBlock { "Base Constraint"; }
getParameterValueByName = Element.GetParameterValueByName(element=all_elements_of_category_3, parameterName=code_block_9)
elevation = Level.Elevation(level=getParameterValueByName)
string_from_object_2 = FromObject(object=elevation)
code_block_10 = CodeBlock(a=code_block_8.out0, b=string_from_object_2, c=code_block_8.out1) { a+b+c; }

# group: Set Room Data
code_block_11 = CodeBlock { "Name"; }
# note: 7. Set Room Data
name_3 = Room.Name(room=all_elements_of_category_2)
toUpper = String.ToUpper(string=name_3)
setParameterByName_2 = Element.SetParameterByName(element=all_elements_of_category_2, parameterName=code_block_11, value=toUpper)  # frozen

# group: Collector (code block)
code_block_12 = CodeBlock { cat = "Walls"; cat_selector = Category.ByName(cat); ElementQueries.OfCategory(cat_selector); }

# group: Parameters (Type)
parameters_2 = Element.Parameters(element=elementType)
parameterType_2 = Parameter.ParameterType(parameter=parameters_2)
value_2 = Parameter.Value(parameter=parameters_2)
isShared_2 = Parameter.IsShared(parameter=parameters_2)

# group: Getting rid of decimals
code_block_13 = CodeBlock { ","; }
split = String.Split(string=string_from_object_2, separator0=code_block_13)
code_block_14 = CodeBlock { 0; }
getItemAtIndex = List.GetItemAtIndex(index=code_block_14)  # unwired: list
map = List.Map(list=split, function=getItemAtIndex)
code_block_15 = CodeBlock { 0; }
getItemAtIndex_2 = List.GetItemAtIndex(list=split@L2, index=code_block_15)

code_block_16 = CodeBlock()
# ---------- code_block_16.designscript (5 lines) ----------
/*Example 01

Set in Comments
Element placed at:  elevation mm
*/;
# ----------------------------------------
code_block_17 = CodeBlock()
# ---------- code_block_17.designscript (5 lines) ----------
/*Example 02

Set in TypeMark
WA.sequence
*/;
# ----------------------------------------

# group: Set Type Mark values
elementType_2 = Element.ElementType(element=all_elements_of_category_3)
uniqueItems = List.UniqueItems(list=elementType_2)
code_block_18 = CodeBlock { "Type Mark"; }
code_block_19 = CodeBlock()
# ---------- code_block_19.designscript (4 lines) ----------
["WA.01",
"WA.02",
"WA.03",
"WA.04"];
# ----------------------------------------
setParameterByName_3 = Element.SetParameterByName(element=uniqueItems, parameterName=code_block_18, value=code_block_19)
