# Dynamo graph Dyn_08_Revit Data Management_Example01_sol.dyn (Dynamo 2.12.1.8246)

# note: Important stuff
# Purple will indicate something important is going on here.
# note: Checking / Outputs
# Orange indicates checking nodes to ensure the script has deployed correctly.
# note: Working / Functions
# Green indicates the working of the script. No changes should be made in these groups unless advised.
# note: Variables / Inputs
# Red indicates Variables that can be altered per project and must be set accordingly before running the script.

# group: Dyn_08_Revit Data Management_Example01
# note: Exercise & Hints
# A. Get model Walls whose Lenght is < 3m.
# B. Get Walls and Floors whose Assembly Code has not been filled in
# C. For all Walls whose A.Code is empty fill in
# “Check element!” on Comments Parameter!
# 	Watch out! Instance vs Type elements!!!
# note: Workflow
# A. Get model Walls whose Lenght is < 3m.
# 1. Collect Walls
# 2. Get WAll Length parameter values
# 3. Filter BoolMask smaller than 3000
# 4. Use Element.Geometry to check on 3D background
# B. Get Walls and Floors whose Assembly Code has not been filled in
# 1. Collect Floors
# 2. Join Wall and Floor lists into one list
# 3. Get ElementType (Assembly Code is a Type parameter!)
# 4. Get Assembly Code values
# 5 Filter BoolMask by empty values
# 6. Use Element.Geometry to check on 3D background
# C. For all Walls whose A.Code is empty fill in
# 1. Use the BoolMask values from B
# 2. Element.GetCategory
# 3. Filter BoolMask on "Walls" values
# 4. Set Comment values (Check element!) on Wall instance elements!

# group: Revit file!
# note: Use this file in combination with the following Revit file:
# Dyn_08_09_12_13_14_15_Exercises.rvt

# group: Select Model Walls
code_block = CodeBlock { cat = "Walls"; cat_selection = Category.ByName(cat); ElementQueries.OfCategory(cat_selection); }
# note: A. Get model Walls whose
# Length is smaller than 3m.
categories = Categories("OST_Walls")
all_elements_of_category = ElementsOfCategory(Category=categories)

# group: Check available Wall parameters
code_block_2 = CodeBlock(e=all_elements_of_category) { e[0].Parameters; }
parameters = Element.Parameters(element=all_elements_of_category)

# group: Get Wall Length Parameter
code_block_3 = CodeBlock(input=all_elements_of_category) { param = "Length"; Elements.Element.GetParameterValueByName(input,param); }
code_block_4 = CodeBlock { "Length"; }
getParameterValueByName = Element.GetParameterValueByName(element=all_elements_of_category, parameterName=code_block_4)

# group: Filter in Walls <2m
code_block_5 = CodeBlock { 3000; }
lt = getParameterValueByName < code_block_5
filterByBoolMask = List.FilterByBoolMask(list=all_elements_of_category, mask=lt)
code_block_6 = CodeBlock(input=getParameterValueByName, value_list=all_elements_of_category)
# ---------- code_block_6.designscript (3 lines) ----------
bool_filter = input < 3000;
bool_mask = List.FilterByBoolMask(value_list, bool_filter);
Dictionary.ValueAtKey(bool_mask, "in");
# ----------------------------------------

# group: Check Elements
geometry = Element.Geometry(element=filterByBoolMask.in)
code_block_7 = CodeBlock { Elements.Element.Geometry(elements); }  # unwired: elements

categories_2 = Categories("OST_Floors")
all_elements_of_category_2 = ElementsOfCategory(Category=categories_2)

# group: Select Model Walls and Floors
# note: B. Get model Walls and Floors
# whose Assembly Code parameter
# has not been filled in.
categories_3 = Categories("OST_Walls")
all_elements_of_category_3 = ElementsOfCategory(Category=categories_3)
join = List.Join(list0=all_elements_of_category_3, list1=all_elements_of_category_2)
code_block_8 = CodeBlock { cats = ["Walls","Floors"]; cat_selection = Category.ByName(cats); ElementQueries.OfCategory(cat_selection); }

# group: Get Wall & Floor Types
elementType = Element.ElementType(element=join)
code_block_9 = CodeBlock(input=join) { Elements.Element.ElementType(input); }

# group: Check available Wall parameters
code_block_10 = CodeBlock(e=elementType) { e[0].Parameters; }
parameters_2 = Element.Parameters(element=elementType)

# group: Get Wall Assembly Code Parameter
code_block_11 = CodeBlock(input=elementType) { param = "Assembly Code"; Elements.Element.GetParameterValueByName(input,param); }
code_block_12 = CodeBlock { "Assembly Code"; }
getParameterValueByName_2 = Element.GetParameterValueByName(element=elementType, parameterName=code_block_12)

# group: Filter in Assembly Code empty
code_block_13 = CodeBlock { ""; }
eq = getParameterValueByName_2 == code_block_13
filterByBoolMask_2 = List.FilterByBoolMask(list=join, mask=eq)
code_block_14 = CodeBlock(input=getParameterValueByName_2, value_list=join)
# ---------- code_block_14.designscript (3 lines) ----------
bool_filter = input == "";
bool_mask = List.FilterByBoolMask(value_list, bool_filter);
Dictionary.ValueAtKey(bool_mask, "in");
# ----------------------------------------

# group: Check Elements
geometry_2 = Element.Geometry(element=filterByBoolMask_2.in)
code_block_15 = CodeBlock { Elements.Element.Geometry(elements); }  # unwired: elements

# group: Get Element Category
code_block_16 = CodeBlock(input=filterByBoolMask_2.in) { Elements.Element.GetCategory(input); }
# note: C. For all Walls whose Assembly Code
# is empty fill in " Check element!"  on
# Comments parameter.
getCategory = Element.GetCategory(element=filterByBoolMask_2.in)

# group: !
string_from_object = FromObject(object=getCategory)
type = Object.Type(object=getCategory)

# group: Filter in Walls
code_block_17 = CodeBlock(input=string_from_object, value_list=filterByBoolMask_2.in)
# ---------- code_block_17.designscript (3 lines) ----------
bool_filter = input == "Walls";
bool_mask = List.FilterByBoolMask(value_list, bool_filter);
Dictionary.ValueAtKey(bool_mask, "in");
# ----------------------------------------
code_block_18 = CodeBlock { "Walls"; }
eq_2 = string_from_object == code_block_18
filterByBoolMask_3 = List.FilterByBoolMask(list=filterByBoolMask_2.in, mask=eq_2)

# group: Set Comments Parameter value
code_block_19 = CodeBlock { "Comments"; "Check element!"; }
setParameterByName = Element.SetParameterByName(element=filterByBoolMask_3.in, parameterName=code_block_19.out0, value=code_block_19.out1)  # frozen
code_block_20 = CodeBlock(input=filterByBoolMask_3.in)  # frozen
# ---------- code_block_20.designscript (3 lines) ----------
param_name = "Comments";
param_value = "Check element!";
Elements.Element.SetParameterByName(input,param_name,param_value);
# ----------------------------------------
