# Dynamo graph Dyn_09_Revit Data Management_Example02_sol.dyn (Dynamo 2.12.1.8246)

# note: Important stuff
# Purple will indicate something important is going on here.
# note: Checking / Outputs
# Orange indicates checking nodes to ensure the script has deployed correctly.
# note: Working / Functions
# Green indicates the working of the script. No changes should be made in these groups unless advised.
# note: Variables / Inputs
# Red indicates Variables that can be altered per project and must be set accordingly before running the script.
# note: B. Get all rooms on first level

# group: Revit file!
# note: Use this file in combination with the following Revit file:
# Dyn_08_09_12_13_14_15_Exercises.rvt

# group: Dyn_09_Revit Data Management_Example02
# note: Exercise & Hints
# A. Get all “Office” rooms
# 	What if someone writes office or Offices ?
# B. Get All Rooms placed at first level
# C. Update toilet room names to “tlt”
# D. Fill in Office rooms OccupancyNumber Parameter based on:
# 	1.5/sqm
# note: Workflow
# A. Get all “Office” rooms
# 1. Get All Rooms
# 2. Get Room Names
# 3. String.Upper on Name values
# 3. Filter BoolMask based on "OFFICE" value
# B. Get All Rooms placed at first level
# 1. Get Level parameter
# 2. Filter BoolMask based on StartsWith 01
# C. Update toilet room names to “tlt”
# 1. Grab name values from A.
# 2. Replace toilet values with tlt
# 3. Set Room name parameter values
# D. Fill in Office rooms OccupancyNumber Parameter based on:
# 1. Use Filered rooms from A.
# 2. Get Area Room parameter values
# 3. Multiply Area values by 1.5
# 4. Round Ceiling values
# 5. Set Area Room parameter values

# group: Select Model Walls
code_block = CodeBlock { cat = "Rooms"; cat_selection = Category.ByName(cat); ElementQueries.OfCategory(cat_selection); }
# note: A. Get all Office rooms
categories = Categories("OST_Rooms")
all_elements_of_category = ElementsOfCategory(Category=categories)

# group: Check available Wall parameters
code_block_2 = CodeBlock(e=all_elements_of_category) { e[0].Parameters; }
parameters = Element.Parameters(element=all_elements_of_category)

# group: Get Room Name parameter
code_block_3 = CodeBlock(input=all_elements_of_category) { param = "Name"; Elements.Element.GetParameterValueByName(input,param); }
code_block_4 = CodeBlock { "Name"; }
getParameterValueByName = Element.GetParameterValueByName(element=all_elements_of_category, parameterName=code_block_4)
name = Room.Name(room=all_elements_of_category)

# group: !
toUpper = String.ToUpper(string=getParameterValueByName)

# group: Filter in Office rooms
code_block_5 = CodeBlock(input=getParameterValueByName, value_list=all_elements_of_category)
# ---------- code_block_5.designscript (4 lines) ----------
input_upper = String.ToUpper(input);
bool_filter = input_upper == "OFFICE";
bool_mask = List.FilterByBoolMask(value_list, bool_filter);
Dictionary.ValueAtKey(bool_mask, "in");
# ----------------------------------------
code_block_6 = CodeBlock { "OFFICE"; }
eq = toUpper == code_block_6
filterByBoolMask = List.FilterByBoolMask(list=all_elements_of_category, mask=eq)

# group: Check output
watch = Watch(filterByBoolMask.in)

# group: Get Level
code_block_7 = CodeBlock(input=all_elements_of_category) { param = "Level"; Elements.Element.GetParameterValueByName(input,param); }
code_block_8 = CodeBlock { "Level"; }
getParameterValueByName_2 = Element.GetParameterValueByName(element=all_elements_of_category, parameterName=code_block_8)

# group: Filter in 01 first string
code_block_9 = CodeBlock(input=getParameterValueByName, value_list=all_elements_of_category)  # same code as code_block_5
code_block_10 = CodeBlock { "01 first"; }
startsWith = String.StartsWith(string=getParameterValueByName_2, searchFor=code_block_10)
filterByBoolMask_2 = List.FilterByBoolMask(list=all_elements_of_category, mask=startsWith)

# group: Get Element Location and Z coordinate
getLocation = Element.GetLocation(element=all_elements_of_category)
Z = Point.Z(point=getLocation)

# group: Get First level elevation
levels = Levels("01 first floor")
elevation = Level.Elevation(level=levels)

# group: Find all indices of first level elevation
allIndicesOf = List.AllIndicesOf(list=Z, item=elevation)

# group: Grab indices
getItemAtIndex = List.GetItemAtIndex(list=all_elements_of_category, index=allIndicesOf)

# group: Check output
watch_2 = Watch(getItemAtIndex)

# group: Check output
watch_3 = Watch(filterByBoolMask_2.in)

# group: Check if both lists are equal
equals = List.Equals(object=watch_2, otherObject=watch_3)

# group: Filter in Toilet rooms
code_block_11 = CodeBlock(input=getParameterValueByName, value_list=all_elements_of_category)
# ---------- code_block_11.designscript (4 lines) ----------
input_upper = String.ToUpper(input);
bool_filter = input_upper == "TOILET";
bool_mask = List.FilterByBoolMask(value_list, bool_filter);
Dictionary.ValueAtKey(bool_mask, "in");
# ----------------------------------------
# note: C. Change toilet to tlt
code_block_12 = CodeBlock { "TOILET"; }
eq_2 = toUpper == code_block_12
filterByBoolMask_3 = List.FilterByBoolMask(list=all_elements_of_category, mask=eq_2)

# group: Set Room name value
code_block_13 = CodeBlock { "Name"; "tlt"; }
setParameterByName = Element.SetParameterByName(element=filterByBoolMask_3.in, parameterName=code_block_13.out0, value=code_block_13.out1)  # frozen
code_block_14 = CodeBlock(input=filterByBoolMask_3.in) { param_name = "Name"; param_value = "tlt"; Elements.Element.SetParameterByName(input,param_name,param_value); }

# group: Get Office Rooms Area
# note: D. OccupancyNumber based on 1.5 / sqm
code_block_15 = CodeBlock { "Area"; }
getParameterValueByName_3 = Element.GetParameterValueByName(element=filterByBoolMask.in, parameterName=code_block_15)
code_block_16 = CodeBlock(input=filterByBoolMask.in) { param = "Area"; Elements.Element.GetParameterValueByName(input,param); }

# group: Calculate Occupancy and Round it
code_block_17 = CodeBlock { 1.5; }
mul = getParameterValueByName_3 * code_block_17
ceiling = Math.Ceiling(number=mul)
code_block_18 = CodeBlock(input=code_block_16.out1) { factor = 1.5; Math.Ceiling(input * factor); }

# group: Set Room name value
code_block_19 = CodeBlock { "OccupancyNumber"; }
setParameterByName_2 = Element.SetParameterByName(element=filterByBoolMask.in, parameterName=code_block_19, value=ceiling)  # frozen
code_block_20 = CodeBlock(input=filterByBoolMask.in, param_value=code_block_18.out1) { param_name = "OccupancyNumber"; Elements.Element.SetParameterByName(input,param_name,param_value); }
