# Dynamo graph Dyn_10_Revit to Excel_sol.dyn (Dynamo 2.12.1.8246)

# note: Important stuff
# Purple will indicate something important is going on here.
# note: Checking / Outputs
# Orange indicates checking nodes to ensure the script has deployed correctly.
# note: Working / Functions
# Green indicates the working of the script. No changes should be made in these groups unless advised.
# note: Variables / Inputs
# Red indicates Variables that can be altered per project and must be set accordingly before running the script.
# note: 3. Get Multiple parameters

# group: Revit file!
# note: Use this file in combination with the following Revit file:
# Dyn_04_07_10_11_Training file.rvt

# group: Dyn_10_Revit to Excel
# note: Workflow
# 1. Collect all Rooms in the model
# 2. Analyze Data.ExportToExcel node
# 3. Get all Room desired Data as a list:
# 	• Check available Room parameters (Element.Parameters)
# 4. Element.GetParameterValueByName (use Map or Cross product)
# 5. List data manipuliation (Transpose, AddItem,...)
# 6. Clean Empty Values Replace them with a @ value:
# 	• If Statement
# 7. List.Chop
# 8. Add headers column (parameter name)
# 9. Export!
# 10. Try with Code Block? :)
# note: Exercise & Hints
# Collect and export the following room data to excel
# 	Room ID
# 	Room Name
# 	Room Number
# 	Level
# 	Room Height (Unbounded Height)
# 	Area
# 	Floor Finish
# 	Ceiling Finish
# 	Wall Finish

# group: Get Model Rooms
# note: 1. Collect model Rooms
code_block = CodeBlock { cat = Category.ByName("Rooms"); ElementQueries.OfCategory(cat); }
all_elements_of_category = ElementsOfCategory(Category=code_block.cat)

# group: Get Required Room Parameters
code_block_2 = CodeBlock()
# ---------- code_block_2.designscript (8 lines) ----------
["Name",
"Number",
"Level",
"Unbounded Height",
"Area",
"Ceiling Finish",
"Wall Finish",
"Floor Finish"];
# ----------------------------------------
id = Element.Id(element=all_elements_of_category)
getParameterValueByName = Element.GetParameterValueByName(parameterName=code_block_2)  # unwired: element
map = List.Map(list=all_elements_of_category, function=getParameterValueByName)
getParameterValueByName_2 = Element.GetParameterValueByName(element=all_elements_of_category, parameterName=code_block_2, lacing=CrossProduct)

# group: Check data
watch = Watch(id)
watch_2 = Watch(map)

# group: Transpose data to add ID at front
transpose = List.Transpose(lists=watch_2)
addItemToFront = List.AddItemToFront(item=watch, list=transpose)
transpose_2 = List.Transpose(lists=addItemToFront)

# group: Adding Headers column befre
string = StringInput("ID")
addItemToFront_2 = List.AddItemToFront(item=string, list=code_block_2)
addItemToFront_3 = List.AddItemToFront(item=addItemToFront_2, list=transpose_2)

# group: Replace empty values
code_block_3 = CodeBlock { ""; }
eq = addItemToFront_3 == code_block_3
string_2 = StringInput("$$")
if_ = RefactoredIf(test=eq@L1, true=string_2, false=addItemToFront_3@L1)

# group: Divide into sublists
count = List.Count(list=addItemToFront_2)
chop = List.Chop(list=if_, lengths=count)

# group: Check data
watch_3 = Watch(chop)

# group: Export To Excel
file_path = Filename(".\aa.xlsx")
code_block_4 = CodeBlock { "Sheet1"; 0; true; false; }
exportToExcel = Data.ExportToExcel(filePath=file_path, sheetName=code_block_4.out0, startRow=code_block_4.out1, startColumn=code_block_4.out1, data=watch_3, overWrite=code_block_4.out2, writeAsString=code_block_4.out2)  # frozen

# group: Check Available Room parameters
parameters = Element.Parameters(element=all_elements_of_category)
code_block_5 = CodeBlock(e=all_elements_of_category) { e[0].Parameters; }

# group: CodeBlocks
file_path_2 = Filename("..\..\Desktop\New Microsoft Excel Worksheet.xlsx")
code_block_6 = CodeBlock { "Sheet1"; 0; true; false; }
get_all_elements = CodeBlock { cat = Category.ByName("Rooms"); ElementQueries.OfCategory(cat); }
get_parameter_values = CodeBlock(e=get_all_elements.out1)
# ---------- get_parameter_values.designscript (15 lines) ----------
// Getting ElementID
id = e.Id;

// Define which parameters will be used for Data extraction
param = ["ID","Name","Number","Limit Offset","Department",
"Base Finish","Ceiling Finish","Wall Finish","Floor Finish"];

// Get Parameter Data from elements
values = Element.GetParameterValueByName(e,param<1>);

// Add IDs to the Dataset
add_1 = List.AddItemToFront(id,values);

// Add Parameter names (headers) for Excel
add_2 = List.AddItemToFront(param, List.Transpose(add_1));
# ----------------------------------------
exportToExcel_2 = Data.ExportToExcel(filePath=file_path_2, sheetName=code_block_6.out0, startRow=code_block_6.out1, startColumn=code_block_6.out1, data=get_parameter_values.add_2, overWrite=code_block_6.out2, writeAsString=code_block_6.out2)  # frozen

# group: Checking
# note: 2. Checking ExportToExcel node
exportToExcel_3 = Data.ExportToExcel()  # unwired: filePath, sheetName, startRow, startColumn, data
