# Dynamo graph Dyn_11_Excel to Revit_sol.dyn (Dynamo 2.12.1.8246)

# note: Important stuff
# Purple will indicate something important is going on here.
# note: Checking / Outputs
# Orange indicates checking nodes to ensure the script has deployed correctly.
# note: Working / Functions
# Green indicates the working of the script. No changes should be made in these groups unless advised.
# note: Variables / Inputs
# Red indicates Variables that can be altered per project and must be set accordingly before running the script.

# group: Revit file!
# note: Use this file in combination with the following Revit file:
# Dyn_04_07_10_11_Training file.rvt

# group: Dyn_11_Excel to Revit
# note: Exercise & Hints
# Write Finish room values from the excel file we previoulsy exported
# note: Workflow
# 1. Analyze Data.ImportExcel node
# 2. List DropItems (headers)
# 3. Transpose list
# 4. Get item at index:
# 	• ID
# 	• Parameters to be added (FF, CF, WF)
# 5. Use ID to get IndexOf  > Element.Id > ItemAtIndex > Room list
# 6. Element.SetParamaterValueByName
# 	• Multiple values  = Multiple Element.Set node
#  7. Try using Code Block?  :)

# group: Get Model Rooms
code_block = CodeBlock { Category.ByName("Rooms"); }
all_elements_of_category = ElementsOfCategory(Category=code_block)

# group: Import Excel data
# note: 1. Collect model Rooms
file_path = Filename("..\..\Desktop\New Microsoft Excel Worksheet.xlsx")
file_from_path = FileObject(path=file_path)
code_block_2 = CodeBlock { "Sheet1"; true; false; }
importExcel = Data.ImportExcel(file=file_from_path, sheetName=code_block_2.out0, readAsStrings=code_block_2.out1, showExcel=code_block_2.out2)

# group: Tanspose and getting rid of headers
code_block_3 = CodeBlock { 1; }
dropItems = List.DropItems(list=importExcel, amount=code_block_3)
transpose = List.Transpose(lists=dropItems)

# group: Select ID column
code_block_4 = CodeBlock { 0; }
getItemAtIndex = List.GetItemAtIndex(list=transpose, index=code_block_4)

# group: Selecting Rooms from ID
id = Element.Id(element=all_elements_of_category)
string_from_object = FromObject(object=id)
indexOf = List.IndexOf(list=string_from_object, element=getItemAtIndex)
getItemAtIndex_2 = List.GetItemAtIndex(list=all_elements_of_category, index=indexOf)

# group: Finish Value columns
code_block_5 = CodeBlock { 5; 6; 7; }
getItemAtIndex_3 = List.GetItemAtIndex(list=transpose, index=code_block_5.out0)
getItemAtIndex_4 = List.GetItemAtIndex(list=transpose, index=code_block_5.out1)
getItemAtIndex_5 = List.GetItemAtIndex(list=transpose, index=code_block_5.out2)

# group: Set Multiple Values
code_block_6 = CodeBlock { "Ceiling Finish"; "Wall Finish"; "Floor Finish"; }  # frozen
setParameterByName = Element.SetParameterByName(element=getItemAtIndex_2, parameterName=code_block_6.out0, value=getItemAtIndex_3)
setParameterByName_2 = Element.SetParameterByName(element=getItemAtIndex_2, parameterName=code_block_6.out1, value=getItemAtIndex_4)
setParameterByName_3 = Element.SetParameterByName(element=getItemAtIndex_2, parameterName=code_block_6.out2, value=getItemAtIndex_5)

# group: Code Block
code_block_7 = CodeBlock(room_collector=all_elements_of_category, input=importExcel)  # frozen
# ---------- code_block_7.designscript (27 lines) ----------
//Getting rooms from Collector
room_collector;
room_id = (room_collector.Id);
room_id_str = room_id + "";

// Getting Excel Data and Split it
param_names = input[0][5..7];
other_values = List.DropItems(input,1);
excel_data = List.Transpose(other_values);

// Split the Values
ID = excel_data[0];
ceiling_finish = excel_data[5];
wall_finish = excel_data[6];
floor_finish = excel_data[7];


param_values = [ceiling_finish, wall_finish, floor_finish];

// Compare Excel Room IDs with Revit IDs
rooms_in_excel = List.IndexOf(room_id_str, ID);
rooms = List.GetItemAtIndex(room_collector, rooms_in_excel);

//Set the parameters values
CF = Elements.Element.SetParameterByName(rooms, param_names[0], param_values[0]);
WF = Elements.Element.SetParameterByName(rooms, param_names[1], param_values[1]);
FF = Elements.Element.SetParameterByName(rooms, param_names[2], param_values[2]);
# ----------------------------------------
