# Dynamo graph Dyn_12_Create Sheets_sol.dyn (Dynamo 2.12.1.8246)

# note: Important stuff
# Purple will indicate something important is going on here.
# note: Checking / Outputs
# Orange indicates checking nodes to ensure the script has deployed correctly.
# note: Working / Functions
# Green indicates the working of the script. No changes should be made in these groups unless advised.
# note: Variables / Inputs
# Red indicates Variables that can be altered per project and must be set accordingly before running the script.

# group: Dyn_12_Create Sheets
# note: Contents
# A. Simple Approach
# 1. Analyze Sheet.ByNameNumberTitleblock
# 2. Create lists using Code Block
# 2. Get Titleblock Category elements
# 3. Get FamilyType.ByName > Element.name for Titleblocks
# 4. Find the IndexOf sheet size and select Family type
# 6. Create sheets!
# B. Set Sheet Parameter values:
# 1. Split Sheet Number values from A to get (Volume, Level and Number)
# 2. Add Extra input values (type and Date)
# 3. Set parameter values (multi node or Code Block)
# C. Set Extra parameter values:
# 1. Repeat B process
# 2. What if we need to do it 200 times? Any solution?
# D. Create Sheets with Views
# 1. Same steps as A
# 2. Pick views and merge them together
# 	• Pay attention to Views and Sheet list lenght! They must be equal!
# 3. What if we needed to do this process for 200 sheets?
# note: Contents
# A. Simple Approach
# Create the following Sheets:
# • Sheet 1
# Name:	Floor plan - ground floor
# Number:	ZZ-00-1102
# Size:	A1
# • Sheet 2
# Name: 	Building A - floor plan - ground floor - part A
# Number:	BA-00-1202A
# Size:	A0++
# • Sheet 3
# Name: 	Section A
# Number:	ZZ-ZZ-2101
# Size:	A2+
# B. Set Sheet parameters values:
# 	ID_VolumeSystem
# 	ID_LevelLocation
# 	ID_Document_Type
# 	ID_Document_Number
# 	Sheet Issue Date (20.09.2022)
# C. Set Extra parameter values
# 	K_Browser01
# 	K_Browser02
# 	K_Browser03
# D. Create Sheets with Views
# Create the following Sheets with their corresponding views:
# • Sheet 1
# Name: Floor plan - first floor
# Number:	ZZ-00-1103
# Size:	A0+
# Views: 	D_ZZ_01_1103_first floor
# 	Floorplan_Generic legend 1-100
# • Sheet 2
# Name:  Office fragment
# Number:	ZZ-ZZ-4101
# Size:	A3
# Views: 	D_ZZ_01_4101_offfice floor plan
# 	D_ZZ_ZZ_4101_office section
# 	Fragment_Generic legend 1-50

# group: Revit file!
# note: Use this file in combination with the following Revit file:
# Dyn_08_09_12_13_14_15_Exercises.rvt

# group: Sheets Creation
# note: 1. Analyze Sheets Creation nodes
byNameNumberTitleBlock = Sheet.ByNameNumberTitleBlock()  # unwired: sheetName, sheetNumber, titleBlockFamilyType
byNameNumberTitleBlockAndView = Sheet.ByNameNumberTitleBlockAndView()  # unwired: sheetName, sheetNumber, titleBlockFamilyType, view
byNameNumberTitleBlockAndViews = Sheet.ByNameNumberTitleBlockAndViews()  # unwired: sheetName, sheetNumber, titleBlockFamilyType, views
# note: Revit 2022
byNameNumberTitleBlockViewAndLocation = Sheet.ByNameNumberTitleBlockViewAndLocation()  # unwired: sheetName, sheetNumber, titleBlockFamilyType, view, location
byNameNumberTitleBlockViewsAndLocations = Sheet.ByNameNumberTitleBlockViewsAndLocations()  # unwired: sheetName, sheetNumber, titleBlockFamilyType, views, locations

# group: File path
# note: 3. Reading Deliverables excel file
file_path = Filename(".\Dyn_00_08_Create Sheets.xlsx")

# group: Import Excel file
file_from_path = FileObject(path=file_path)
code_block = CodeBlock { "Deliverables"; true; false; }
importExcel = Data.ImportExcel(file=file_from_path, sheetName=code_block.out0, readAsStrings=code_block.out1, showExcel=code_block.out2)

# group: Drop not needed data rows
code_block_2 = CodeBlock { 8; }
dropItems = List.DropItems(list=importExcel, amount=code_block_2)
transpose = List.Transpose(lists=dropItems)
string_from_object = FromObject(object=transpose)

# group: Replace nulls with empty values
code_block_3 = CodeBlock { "null"; ""; }
replace = String.Replace(string=string_from_object, searchFor=code_block_3.out0, replaceWith=code_block_3.out1)

# group: Filter in only "D" rows
code_block_4 = CodeBlock { 8; }
document_type = List.GetItemAtIndex(list=replace, index=code_block_4)
code_block_5 = CodeBlock { "D"; }
allIndicesOf = List.AllIndicesOf(list=document_type, item=code_block_5)
getItemAtIndex = List.GetItemAtIndex(list=replace@L2, index=allIndicesOf)

# group: Clean data!
clean_data = Watch(getItemAtIndex)

# group: Getting data
code_block_6 = CodeBlock { 4; 6; 8; 12; 13; 15; 17; 19; 21; }
title = List.GetItemAtIndex(list=clean_data, index=code_block_6.out5)
functional_breakdown = List.GetItemAtIndex(list=clean_data, index=code_block_6.out0)
spatial_breakdown = List.GetItemAtIndex(list=clean_data, index=code_block_6.out1)
number_1 = List.GetItemAtIndex(list=clean_data, index=code_block_6.out3)
number_2 = List.GetItemAtIndex(list=clean_data, index=code_block_6.out4)
add = number_1 + number_2
size = List.GetItemAtIndex(list=clean_data, index=code_block_6.out6)
document_type_2 = List.GetItemAtIndex(list=clean_data, index=code_block_6.out2)
date = List.GetItemAtIndex(list=clean_data, index=code_block_6.out8)

# group: Getting all Titleblocks
categories = Categories("OST_TitleBlocks")
all_elements_of_category = ElementsOfCategory(Category=categories)

# group: Compare Sheet sizes with families
name = Element.Name(element=all_elements_of_category)
byName = FamilyType.ByName(name=name)
indexOf = List.IndexOf(list=name, element=size)
getItemAtIndex_2 = List.GetItemAtIndex(list=byName, index=indexOf)

# group: Combining data for Sheet Creation
sheet_name = CodeBlock(title=title) { title; }
sheet_number = CodeBlock(functional=functional_breakdown, spatial=spatial_breakdown, number=add) { functional+"-"+spatial+"-"+number; }
titleblocks = CodeBlock(ttb=getItemAtIndex_2) { ttb; }

# group: Sheet Creation
byNameNumberTitleBlock_2 = Sheet.ByNameNumberTitleBlock(sheetName=sheet_name, sheetNumber=sheet_number, titleBlockFamilyType=titleblocks)  # frozen

status = List.GetItemAtIndex(list=clean_data, index=code_block_6.out7)

# group: Set Sheet Parameter values
code_block_7 = CodeBlock(input=byNameNumberTitleBlock_2, functional=functional_breakdown, spatial=spatial_breakdown, type=document_type_2, number=add, status=status, date=date)
# ---------- code_block_7.designscript (7 lines) ----------
sheets = input;
Elements.Element.SetParameterByName(sheets,"ID_VolumeSystem",functional);
Elements.Element.SetParameterByName(sheets,"ID_LevelLocation",spatial);
Elements.Element.SetParameterByName(sheets,"ID_Document_Type",type);
Elements.Element.SetParameterByName(sheets,"ID_Document_Number",number);
Elements.Element.SetParameterByName(sheets,"ID_DocumentStatus",status);
Elements.Element.SetParameterByName(sheets,"Sheet Issue Date",date);
# ----------------------------------------

# group: Extra: B mapping
code_block_8 = CodeBlock { ""; }
split = String.Split(string=number_1, separator0=code_block_8)
code_block_9 = CodeBlock { 0; }
getItemAtIndex_3 = List.GetItemAtIndex(list=split@L2, index=code_block_9)
code_block_10 = CodeBlock(nr2=getItemAtIndex_3, nr3=number_1) { B02 = nr2+"000"; B03 = nr3+"00"; }
K_Browser02 = CodeBlock(map02=code_block_10.B02)
# ---------- K_Browser02.designscript (11 lines) ----------
map02 == "0000" ? map02+"_Starting Documents":
map02 =="1000" ? map02+"_Plans":
map02 =="2000" ? map02+"_Sections":
map02 =="3000" ? map02+"_Elevations":
map02 =="4000" ? map02+"_Fragments":
map02 =="5000" ? map02+"_Details":
map02 =="6000" ? map02+"_Element drawings":
map02 =="7000" ? map02+"_Furniture drawings":
map02 =="8000" ? map02+"_Overview plans":
map02 =="9000" ? map02+"_Existing plans":
null;
# ----------------------------------------
K_Browser03 = CodeBlock(map03=code_block_10.B03)
# ---------- K_Browser03.designscript (40 lines) ----------
map03 =="0000" ? map03+"_Base documents":
map03 =="0100" ? map03+"_Presentation":
map03 =="0200" ? map03+"_Plans":
map03 =="0300" ? map03+"_Sections":

map03 =="1000" ? map03+"_Site plan":
map03 =="1100" ? map03+"_Floor plan type 1":
map03 =="1200" ? map03+"_Floor plan type 2":
map03 =="1500" ? map03+"_Ceiling plan type 1":
map03 =="1600" ? map03+"_Ceiling plan type 2":

map03 =="2000" ? map03+"_Urban section":
map03 =="2100" ? map03+"_Section type 1":
map03 =="2200" ? map03+"_Section type 2":

map03 =="3100" ? map03+"_Elevation type 1":
map03 =="3200" ? map03+"_Elevation type 2":

map03 =="4100" ? map03+"_Fragment type 1":
map03 =="4200" ? map03+"_Fragment type 2":

map03 =="5000" ? map03+"_Detail principles":
map03 =="5100" ? map03+"_Detail book - exterior":
map03 =="5200" ? map03+"_Detail book - interior":

map03 =="6100" ? map03+"_Doors and windows - exterior":
map03 =="6200" ? map03+"_Doors and windows - interior":
map03 =="6300" ? map03+"_Prefabricated elements":

map03 =="7000" ? map03+"_Furniture - general arrangement":
map03 =="7100" ? map03+"_Furniture - fixed furniture":
map03 =="7200" ? map03+"_Furniture - movable furniture":

map03 =="8100" ? map03+"_Overview plan - areas":
map03 =="8200" ? map03+"_Overview plan - fire security":
map03 =="8300" ? map03+"_Overview plan - interior finishes":

map03 =="9100" ? map03+"_Existing plans":
map03 =="9200" ? map03+"_Demolition plans":
null;
# ----------------------------------------

# group: Extra!
# note: What about setting up Broswer parameters?
browser_mapping = CodeBlock(sheets=byNameNumberTitleBlock_2, B02=K_Browser02, B03=K_Browser03)
# ---------- browser_mapping.designscript (3 lines) ----------
Elements.Element.SetParameterByName(sheets,"K_Browser01","D_Deliverables");
Elements.Element.SetParameterByName(sheets,"K_Browser02",B02);
Elements.Element.SetParameterByName(sheets,"K_Browser03",B03);
# ----------------------------------------

# group: List inputs for Sheet creation
# note: Create Sheets
sheet_names = CodeBlock()
# ---------- sheet_names.designscript (5 lines) ----------
[
"Floor plan - ground floor",
"Building A - floor plan - ground floor - part A",
"Section A"
];
# ----------------------------------------
sheet_numbers = CodeBlock()
# ---------- sheet_numbers.designscript (5 lines) ----------
[
"ZZ-00-1102",
"BA-00-1202A",
"ZZ-ZZ-2101"
];
# ----------------------------------------
sheet_sizes = CodeBlock()
# ---------- sheet_sizes.designscript (5 lines) ----------
[
"A1",
"A0++",
"A2+"
];
# ----------------------------------------

# group: Getting all Titleblocks
categories_2 = Categories("OST_TitleBlocks")
all_elements_of_category_2 = ElementsOfCategory(Category=categories_2)

# group: Compare Sheet sizes with families
name_2 = Element.Name(element=all_elements_of_category_2)
byName_2 = FamilyType.ByName(name=name_2)
indexOf_2 = List.IndexOf(list=name_2, element=sheet_sizes)
getItemAtIndex_4 = List.GetItemAtIndex(list=byName_2, index=indexOf_2)

# group: Sheets creation!
byNameNumberTitleBlock_3 = Sheet.ByNameNumberTitleBlock(sheetName=sheet_names, sheetNumber=sheet_numbers, titleBlockFamilyType=getItemAtIndex_4)  # frozen

# group: Split Sheet Number
# note: Setting up Sheet Parameters?
# ID_VolumeSystem
# ID_LevelLocation
# ID_Document_Type
# ID_Document_Number
# Sheet Isssue Date
code_block_11 = CodeBlock { "-"; }
split_2 = String.Split(string=sheet_numbers, separator0=code_block_11)

# group: Grab each element
code_block_12 = CodeBlock { 0; 1; 2; }
getItemAtIndex_5 = List.GetItemAtIndex(list=split_2@L2, index=code_block_12.out0)
getItemAtIndex_6 = List.GetItemAtIndex(list=split_2@L2, index=code_block_12.out1)
getItemAtIndex_7 = List.GetItemAtIndex(list=split_2@L2, index=code_block_12.out2)

# group: Checking values
functional = Watch(getItemAtIndex_5)
spatial = Watch(getItemAtIndex_6)
number = Watch(getItemAtIndex_7)

# group: Extra input
sheet_issue_date = CodeBlock { "20.09.2022"; }

# group: Set Sheet Parameter values
code_block_13 = CodeBlock(input_sheets=byNameNumberTitleBlock_3, functional=functional, spatial=spatial, number=number, issue_date=sheet_issue_date)
# ---------- code_block_13.designscript (6 lines) ----------
sheets = input_sheets;
Elements.Element.SetParameterByName(sheets,"ID_VolumeSystem",functional);
Elements.Element.SetParameterByName(sheets,"ID_LevelLocation",spatial);
Elements.Element.SetParameterByName(sheets,"ID_Document_Type","D");
Elements.Element.SetParameterByName(sheets,"ID_Document_Number",number);
Elements.Element.SetParameterByName(sheets,"Sheet Issue Date", issue_date);
# ----------------------------------------

# group: Challenge 1
# note: Setting Browser mapping paramaters automatically?
K_Browser01 = CodeBlock { []; }
K_Browser02_2 = CodeBlock { []; }
K_Browser03_2 = CodeBlock { []; }

# group: Sheets + Views
sheet_names_2 = CodeBlock()
# ---------- sheet_names_2.designscript (4 lines) ----------
[
"Floor finish plan - ground floor",
"RCP - first floor"
];
# ----------------------------------------
sheet_numbers_2 = CodeBlock()
# ---------- sheet_numbers_2.designscript (4 lines) ----------
[
"ZZ-ZZ-8301.01",
"ZZ-ZZ-1502"
];
# ----------------------------------------
# note: Placing view on each sheet?
sheet_sizes_2 = CodeBlock()
# ---------- sheet_sizes_2.designscript (4 lines) ----------
[
"A2",
"A1+"
];
# ----------------------------------------

# group: Getting all Titleblocks
categories_3 = Categories("OST_TitleBlocks")
all_elements_of_category_3 = ElementsOfCategory(Category=categories_3)

# group: Compare Sheet sizes with families
name_3 = Element.Name(element=all_elements_of_category_3)
byName_3 = FamilyType.ByName(name=name_3)
indexOf_3 = List.IndexOf(list=name_3, element=sheet_sizes_2)
getItemAtIndex_8 = List.GetItemAtIndex(list=byName_3, index=indexOf_3)

# group: Picking views
views = Views()  # nothing selected
views_2 = Views()  # nothing selected
views_3 = Views()  # nothing selected

# group: Views - Sheets list lenght need to match!
# note: Sheet list = 2 items
# Views list = 3 items
list_create = List.Create(item0=views, item1=views_2)
list_create_2 = List.Create(item0=list_create, item1=views_3)

# group: Sheet Creation
byNameNumberTitleBlockAndViews_2 = Sheet.ByNameNumberTitleBlockAndViews(sheetName=sheet_names_2, sheetNumber=sheet_numbers_2, titleBlockFamilyType=getItemAtIndex_8, views=list_create_2)  # frozen
