# Dynamo graph Dyn_13_Create Sheets from Excel file_sol.dyn (Dynamo 2.12.1.8246)

# note: Important stuff
# Purple will indicate something important is going on here.
# note: Checking / Outputs
# Orange indicates checking nodes to ensure the script has deployed correctly.
# note: Working / Functions
# Green indicates the working of the script. No changes should be made in these groups unless advised.
# note: Variables / Inputs
# Red indicates Variables that can be altered per project and must be set accordingly before running the script.

# group: Revit file!
# note: Use this file in combination with the following Revit file:
# Dyn_08_09_12_13_14_15_Exercises.rvt

# group: Excel file!
# note: The following worksheet contains all needed Sheet data :
# Dyn_13_Create Sheets from Excel file.xlsx

# group: Dyn_13_Create Sheets from Excel file
# note: Exercise & Hints
# Create Sheets and fill in Sheet required parameters from an excel worksheet.
# Excel data must be cleaned
# 	 null values, non-desired columns,...
# Not all deliverables in the Excel file are neccesarely Revit Drawings:
# 	If you check Type column only [D] values correspond to Drawings.
#  Try to set  all Sheet Parameters like the did in the previous file
# Challenge: Set Sheet Browser mapping values!
# note: Workflow
# 1. Get Excel Data
# 2. Drop unnecesary Data
# 3. Transpose data so that each columns correspond to a parameter
# 4. Replace null values with empty string
# 5. Filter Type “D”  values (Drawings)
# 6. Get each sublist separately
# 7. Compare Sheet Size With Titleblock Family
# 8. Create Sheets!
# 9. Set Sheet Parameters by using all grabbed data on step 6
# 10. Extra Browser parameter values?

# group: File path
# note: 1. Reading excel file
file_path = Filename(".\Dyn_08_Create Sheets.xlsx")

# group: Import Excel file
file_from_path = FileObject(path=file_path)
code_block = CodeBlock { "Deliverables"; true; false; }
importExcel = Data.ImportExcel(file=file_from_path, sheetName=code_block.out0, readAsStrings=code_block.out1, showExcel=code_block.out2)

# group: Drop not needed data rows
code_block_2 = CodeBlock { 8; }
dropItems = List.DropItems(list=importExcel, amount=code_block_2)
transpose = List.Transpose(lists=dropItems)
string_from_object = FromObject(object=transpose)

# group: Replace nulls with empty values
code_block_3 = CodeBlock { "null"; ""; }
replace = String.Replace(string=string_from_object, searchFor=code_block_3.out0, replaceWith=code_block_3.out1)

# group: Filter in only "D" rows
code_block_4 = CodeBlock { 8; }
document_type = List.GetItemAtIndex(list=replace, index=code_block_4)
code_block_5 = CodeBlock { "D"; }
allIndicesOf = List.AllIndicesOf(list=document_type, item=code_block_5)
getItemAtIndex = List.GetItemAtIndex(list=replace@L2, index=allIndicesOf)

# group: Clean data!
clean_data = Watch(getItemAtIndex)

# group: Getting data
code_block_6 = CodeBlock { 4; 6; 8; 12; 13; 15; 17; 19; 21; }
title = List.GetItemAtIndex(list=clean_data, index=code_block_6.out5)
functional_breakdown = List.GetItemAtIndex(list=clean_data, index=code_block_6.out0)
spatial_breakdown = List.GetItemAtIndex(list=clean_data, index=code_block_6.out1)
number_1 = List.GetItemAtIndex(list=clean_data, index=code_block_6.out3)
number_2 = List.GetItemAtIndex(list=clean_data, index=code_block_6.out4)
add = number_1 + number_2
size = List.GetItemAtIndex(list=clean_data, index=code_block_6.out6)
document_type_2 = List.GetItemAtIndex(list=clean_data, index=code_block_6.out2)
date = List.GetItemAtIndex(list=clean_data, index=code_block_6.out8)

# group: Getting all Titleblocks
categories = Categories("OST_TitleBlocks")
all_elements_of_category = ElementsOfCategory(Category=categories)

# group: Compare Sheet sizes with families
name = Element.Name(element=all_elements_of_category)
byName = FamilyType.ByName(name=name)
indexOf = List.IndexOf(list=name, element=size)
getItemAtIndex_2 = List.GetItemAtIndex(list=byName, index=indexOf)

# group: Combining data for Sheet Creation
sheet_name = CodeBlock(title=title) { title; }
sheet_number = CodeBlock(functional=functional_breakdown, spatial=spatial_breakdown, number=add) { functional+"-"+spatial+"-"+number; }
titleblocks = CodeBlock(ttb=getItemAtIndex_2) { ttb; }

# group: Sheet Creation
byNameNumberTitleBlock = Sheet.ByNameNumberTitleBlock(sheetName=sheet_name, sheetNumber=sheet_number, titleBlockFamilyType=titleblocks)  # frozen

status = List.GetItemAtIndex(list=clean_data, index=code_block_6.out7)

# group: Set Sheet Parameter values
code_block_7 = CodeBlock(input=byNameNumberTitleBlock, functional=functional_breakdown, spatial=spatial_breakdown, type=document_type_2, number=add, status=status, date=date)
# ---------- code_block_7.designscript (7 lines) ----------
sheets = input;
Elements.Element.SetParameterByName(sheets,"ID_VolumeSystem",functional);
Elements.Element.SetParameterByName(sheets,"ID_LevelLocation",spatial);
Elements.Element.SetParameterByName(sheets,"ID_Document_Type",type);
Elements.Element.SetParameterByName(sheets,"ID_Document_Number",number);
Elements.Element.SetParameterByName(sheets,"ID_DocumentStatus",status);
Elements.Element.SetParameterByName(sheets,"Sheet Issue Date",date);
# ----------------------------------------

# group: Extra: B mapping
code_block_8 = CodeBlock { ""; }
split = String.Split(string=number_1, separator0=code_block_8)
code_block_9 = CodeBlock { 0; }
getItemAtIndex_3 = List.GetItemAtIndex(list=split@L2, index=code_block_9)
code_block_10 = CodeBlock(nr2=getItemAtIndex_3, nr3=number_1) { B02 = nr2+"000"; B03 = nr3+"00"; }
K_Browser02 = CodeBlock(map02=code_block_10.B02)
# ---------- K_Browser02.designscript (11 lines) ----------
map02 == "0000" ? map02+"_Starting Documents":
map02 =="1000" ? map02+"_Plans":
map02 =="2000" ? map02+"_Sections":
map02 =="3000" ? map02+"_Elevations":
map02 =="4000" ? map02+"_Fragments":
map02 =="5000" ? map02+"_Details":
map02 =="6000" ? map02+"_Element drawings":
map02 =="7000" ? map02+"_Furniture drawings":
map02 =="8000" ? map02+"_Overview plans":
map02 =="9000" ? map02+"_Existing plans":
null;
# ----------------------------------------
K_Browser03 = CodeBlock(map03=code_block_10.B03)
# ---------- K_Browser03.designscript (40 lines) ----------
map03 =="0000" ? map03+"_Base documents":
map03 =="0100" ? map03+"_Presentation":
map03 =="0200" ? map03+"_Plans":
map03 =="0300" ? map03+"_Sections":

map03 =="1000" ? map03+"_Site plan":
map03 =="1100" ? map03+"_Floor plan type 1":
map03 =="1200" ? map03+"_Floor plan type 2":
map03 =="1500" ? map03+"_Ceiling plan type 1":
map03 =="1600" ? map03+"_Ceiling plan type 2":

map03 =="2000" ? map03+"_Urban section":
map03 =="2100" ? map03+"_Section type 1":
map03 =="2200" ? map03+"_Section type 2":

map03 =="3100" ? map03+"_Elevation type 1":
map03 =="3200" ? map03+"_Elevation type 2":

map03 =="4100" ? map03+"_Fragment type 1":
map03 =="4200" ? map03+"_Fragment type 2":

map03 =="5000" ? map03+"_Detail principles":
map03 =="5100" ? map03+"_Detail book - exterior":
map03 =="5200" ? map03+"_Detail book - interior":

map03 =="6100" ? map03+"_Doors and windows - exterior":
map03 =="6200" ? map03+"_Doors and windows - interior":
map03 =="6300" ? map03+"_Prefabricated elements":

map03 =="7000" ? map03+"_Furniture - general arrangement":
map03 =="7100" ? map03+"_Furniture - fixed furniture":
map03 =="7200" ? map03+"_Furniture - movable furniture":

map03 =="8100" ? map03+"_Overview plan - areas":
map03 =="8200" ? map03+"_Overview plan - fire security":
map03 =="8300" ? map03+"_Overview plan - interior finishes":

map03 =="9100" ? map03+"_Existing plans":
map03 =="9200" ? map03+"_Demolition plans":
null;
# ----------------------------------------

# group: Extra!
# note: What about setting up Broswer parameters?
browser_mapping = CodeBlock(sheets=byNameNumberTitleBlock, B02=K_Browser02, B03=K_Browser03)
# ---------- browser_mapping.designscript (3 lines) ----------
Elements.Element.SetParameterByName(sheets,"K_Browser01","D_Deliverables");
Elements.Element.SetParameterByName(sheets,"K_Browser02",B02);
Elements.Element.SetParameterByName(sheets,"K_Browser03",B03);
# ----------------------------------------

# group: Check mapping values
watch = Watch(K_Browser02)
watch_2 = Watch(K_Browser03)

# group: Code Block
sheet_data = CodeBlock()  # unwired: data
# ---------- sheet_data.designscript (12 lines) ----------
// Get data values from excel data input
functional = data[4];
spatial = data[6];
doc_type = data[8];
doc_number = data[12] + data[13];
status = data[19];
date = data[21];

// Main relevant data for Sheet creation
sheet_name = data[15];
sheet_number = functional + "-" + spatial + "-" + doc_number;
sheet_size = data[17];
# ----------------------------------------
code_block_11 = CodeBlock(sheet_size=sheet_data.sheet_size)
# ---------- code_block_11.designscript (11 lines) ----------
// Get all project titleblock
cat = Category.ByName("Title Blocks");
ttb_collector = ElementQueries.OfCategory(cat);

// Get name and family types
ttb_name = ttb_collector.Name;
ttb_family = FamilyType.ByName(ttb_name);

// Find indices on ttb list
find_index = List.IndexOf(ttb_name,sheet_size);
List.GetItemAtIndex(ttb_family, find_index);
# ----------------------------------------
