# Dynamo graph Dyn_14_Room numbering_sol.dyn (Dynamo 2.12.1.8246)

# note: Important stuff
# Purple will indicate something important is going on here.
# note: Checking / Outputs
# Orange indicates checking nodes to ensure the script has deployed correctly.
# note: Working / Functions
# Green indicates the working of the script. No changes should be made in these groups unless advised.
# note: Variables / Inputs
# Red indicates Variables that can be altered per project and must be set accordingly before running the script.

# group: Revit file!
# note: Use this file in combination with the following Revit file:
# Dyn_08_09_12_13_14_15_Exercises.rvt

# group: Dyn_14_Room numbering
# note: Workflow
# 1. Get All model Rooms
# 2. We need to find a logic to rename rooms
# 	level.sequence	01.001
# 	Wacth out for basement -1
# 2. GetParameterValue “Level”
# 3. GroupByKey > Level values
# 4. From this list Get level values again
# FOR THE LEVEL DIGITS VALUE:
# 5. Flatten the list by 1 level and Split the level by “ “ spacing
# 6. List.Map and Grab first item (two digits)
# 7. Replace values if needed (basement, mezzanine, roof,...)
# 8. Flatten the list!
# FOR THE SEQUENCE:
# 9. We need to produce a sequence based on XXX (001,002,003,...)
# 	Sequence resets on every level
# 10. Count for every GroupByKey level (list@level!)
# 11. Add a sequence (0.001..#input..0.001)
# 12. String from object and then Substring!
# 13. Flatten
# 14. a+”.”+b to Concatenate the strings
# 15. Element.SetParameter “Number”
# note: Exercise & Hints
# Apply a specific sequence logic to model Rooms.
# 1. Use String.Concatenate to build the new number
# 2. Check always your output, there might be some non-desired level values...

# group: Room number sequence
code_block = CodeBlock()
# ---------- code_block.designscript (7 lines) ----------
/*
Defining room sequence:
	Level.sequence
	01.001
	00.010

*/;
# ----------------------------------------

# group: Getting all model rooms
code_block_2 = CodeBlock { cat = Category.ByName("Rooms"); ElementQueries.OfCategory(cat); }
categories = Categories("OST_Rooms")
all_elements_of_category = ElementsOfCategory(Category=categories)

# group: Getting Level parameter
code_block_3 = CodeBlock { "Level"; }
getParameterValueByName = Element.GetParameterValueByName(element=all_elements_of_category, parameterName=code_block_3)

# group: Grouping Rooms by Level value
groupByKey = List.GroupByKey(list=all_elements_of_category, keys=getParameterValueByName)

# group: Flatten Rooms list
flatten = List.Flatten(list=groupByKey.groups)

# group: Get Level values again (double check)
code_block_4 = CodeBlock { "Level"; }
getParameterValueByName_2 = Element.GetParameterValueByName(element=groupByKey.groups, parameterName=code_block_4)

# group: Check values
watch = Watch(getParameterValueByName_2)

# group: Flatten the list, Split on Space and get First item (XX)
flatten_2 = List.Flatten(list=watch)
code_block_5 = CodeBlock { " "; }
split = String.Split(string=flatten_2, separator0=code_block_5)
code_block_6 = CodeBlock { 0; }
getItemAtIndex = List.GetItemAtIndex(list=split@L2, index=code_block_6)

# group: Check values
watch_2 = Watch(getItemAtIndex)

# group: Replace -1 values
code_block_7 = CodeBlock { "-1"; "B1"; }
replace = String.Replace(string=watch_2, searchFor=code_block_7.out0, replaceWith=code_block_7.out1)

# group: Check values
watch_3 = Watch(replace)

# group: Getting number of items of each sublist
count = List.Count(list=watch@L2)

# group: Create Sequences for each sublist
code_block_8 = CodeBlock { 0.001; }
sequence = Sequence(start=code_block_8, amount=count, step=code_block_8)

# group: Convert into String, Get Substring values and Flatten
string_from_object = FromObject(object=sequence)
code_block_9 = CodeBlock { 2; 3; }
substring = String.Substring(string=string_from_object, startIndex=code_block_9.out0, length=code_block_9.out1)
flatten_3 = List.Flatten(list=substring)

# group: Check values
watch_4 = Watch(flatten_3)

# group: Concatenate values
sequence_2 = CodeBlock(a=watch_3, b=watch_4) { a + "." + b; }

# group: Check values
watch_5 = Watch(sequence_2)

# group: Set Number values
code_block_10 = CodeBlock { "Number"; }
setParameterByName = Element.SetParameterByName(element=flatten, parameterName=code_block_10, value=watch_5)

# group: Check available parameters
code_block_11 = CodeBlock(e=flatten) { e[0].Parameters; }
