# Dynamo graph Dyn_15_Element Grid location.dyn (Dynamo 2.12.1.8246)

# note: Variables / Inputs
# Red indicates Variables that can be altered per project and must be set accordingly before running the script.
# note: Working / Functions
# Green indicates the working of the script. No changes should be made in these groups unless advised.
# note: Checking / Outputs
# Orange indicates checking nodes to ensure the script has deployed correctly.
# note: Important stuff
# Purple will indicate something important is going on here.

# group: Dyn_15_Element Grid location
# note: Exercise & Hints
# Update a sequence previously applied to model rooms.
# 1. Plug and update information created on script 14!
# 2.  Select Model grids or find a logic to select horizontal and vertical grids!

# group: Revit file!
# note: Use this file in combination with the following Revit file:
# Dyn_08_09_12_13_14_15_Exercises.rvt

# group: Updated Room number sequence
code_block = CodeBlock()
# ---------- code_block.designscript (14 lines) ----------
/*
Updated room number sequence:
	Level.location(HgridVGrid).sequence
	01.A1.01
	00.B1.10

Sequence starts at each level.location
value
	01.A1.01
	01.A1.02
	01.A2.01
	...

*/;
# ----------------------------------------
