# Dynamo graph Dyn_15_Element Grid location_sol.dyn (Dynamo 2.12.1.8246)

# note: Variables / Inputs
# Red indicates Variables that can be altered per project and must be set accordingly before running the script.
# note: Working / Functions
# Green indicates the working of the script. No changes should be made in these groups unless advised.
# note: Checking / Outputs
# Orange indicates checking nodes to ensure the script has deployed correctly.
# note: Important stuff
# Purple will indicate something important is going on here.

# group: Dyn_15_Element Grid location
# note: Workflow
# Room Number sequence based on:
# 	Level.Location.Sequence
# 1. Plug Script used on 14, we will update and reuse it!
# LEVEL
# 1. Level values will be the same
# 2. Sequence needs to be updated
# LOCATION
# * Quick and Easy: Select the grids manually by using SelectModelElements node
# 1. Grab all Model Grids
# 2. Convert the Grid into a curve and Grab Start and End points
# 3. Create a VectorByTwoPoint (start end of each grid.curve)
# 4. Measure the Angle of each vector from XAxis and Round the values
# 5. OrBoolean based on Angle value
# 	0 or 180 degrees = horizontal
# 	90 or 270 degrees = vertical
# 	?? = other project specific grid angle values
# 6. Use  BoolMask to grab Horizontal and Vertical in two different list
# 7. Convert Rooms into Solids with Element.Geometry
# 8. Grab Solid.Centroid to get Center room point
# 9. Geometry.DistanceTo between Centroid and Grid.Curve (H and V in cross lacing)
# 10. Grab Minimun item (closest grid) of each sublist
# 11. Get IndexOf and ItemAtIndex to select Grids and get their name (list@level!)
# SEQUENCE
# 1. Update Substring length from 3 to 2
# 2. List.Count should be updated based on GroupByKey Level.Location concat values
# Concat all three values and Set the parameter
# note: Exercise & Hints
# Apply a specific sequence logic to model Rooms.
# 1. Use String.Concatenate to build the new number
# 2. Check always your output, there might be some non-desired level values...

# group: Revit file!
# note: Use this file in combination with the following Revit file:
# Dyn_08_09_12_13_14_15_Exercises.rvt

# group: Getting all model rooms
code_block = CodeBlock { cat = Category.ByName("Rooms"); ElementQueries.OfCategory(cat); }
# note: 2. Getting all model rooms
categories = Categories("OST_Rooms")
all_elements_of_category = ElementsOfCategory(Category=categories)

# group: Get Solid Centroid!
location = Room.Location()  # unwired: room
geometry = Element.Geometry(element=all_elements_of_category)
flatten = List.Flatten(list=geometry)
centroid = Solid.Centroid(solid=flatten)
getLocation = Element.GetLocation()  # unwired: element

# group: Select H & V grids
horizontal_grids = DSModelElementsSelection()  # 1 picked in the model
vertical_grids = DSModelElementsSelection()  # 1 picked in the model

# group: Getting Level parameter
code_block_2 = CodeBlock { "Level"; }
getParameterValueByName = Element.GetParameterValueByName(element=all_elements_of_category, parameterName=code_block_2)

# group: Grouping Rooms by Level value
groupByKey = List.GroupByKey(list=all_elements_of_category, keys=getParameterValueByName)

# group: Get Level values again (double check)
code_block_3 = CodeBlock { "Level"; }
getParameterValueByName_2 = Element.GetParameterValueByName(element=groupByKey.groups, parameterName=code_block_3)

# group: Check values
watch = Watch(getParameterValueByName_2)

# group: Flatten the list, Split on Space and get First item (XX)
flatten_2 = List.Flatten(list=watch)
code_block_4 = CodeBlock { " "; }
split = String.Split(string=flatten_2, separator0=code_block_4)
code_block_5 = CodeBlock { 0; }
getItemAtIndex = List.GetItemAtIndex(list=split@L2, index=code_block_5)

# group: Check values
watch_2 = Watch(getItemAtIndex)

# group: Replace -1 values
code_block_6 = CodeBlock { "-1"; "B1"; }
replace = String.Replace(string=watch_2, searchFor=code_block_6.out0, replaceWith=code_block_6.out1)

# group: Check values
watch_3 = Watch(replace)

# group: Get All Grids
code_block_7 = CodeBlock { cat = Category.ByName("Grids"); ElementQueries.OfCategory(cat); }

# group: Create a Vector From Curve Start and End
curve = Grid.Curve(grid=code_block_7.out1)
startPoint = Curve.StartPoint(curve=curve)
endPoint = Curve.EndPoint(curve=curve)
byTwoPoints = Vector.ByTwoPoints(start=startPoint, end=endPoint)

# group: Measure Grid Angle from X Axis
XAxis = Vector.XAxis()
ZAxis = Vector.ZAxis()
angleAboutAxis = Vector.AngleAboutAxis(vector=byTwoPoints, otherVector=XAxis, rotationAxis=ZAxis)
round = Math.Round(number=angleAboutAxis)

# group: OrBoolean fro Horizontal Grids
code_block_8 = CodeBlock { 0; 180; }
eq = round == code_block_8.out0
eq_2 = round == code_block_8.out1
or_ = eq || eq_2

# group: BoolMask
filterByBoolMask = List.FilterByBoolMask(list=code_block_7.out1, mask=or_)

# group: Checking output
h_grids = Watch(filterByBoolMask.in)
v_grids = Watch(filterByBoolMask.out)

# group: Get Grid.Curve
curve_2 = Grid.Curve(grid=h_grids)
curve_3 = Grid.Curve(grid=v_grids)

# group: Evaluate Distance
# note: Distance between Element Location pt. and each Grid Curve (Lacing to Cross)
distanceTo = Geometry.DistanceTo(geometry=centroid, other=curve_2, lacing=CrossProduct)
distanceTo_2 = Geometry.DistanceTo(geometry=centroid, other=curve_3, lacing=CrossProduct)

# group: Grab Minimum item on each Sublist
minimumItem = List.MinimumItem(list=distanceTo@L2)
minimumItem_2 = List.MinimumItem(list=distanceTo_2@L2)

# group: Seach Index and Grab Grid item
indexOf = List.IndexOf(list=distanceTo@L2, element=minimumItem@L1)
getItemAtIndex_2 = List.GetItemAtIndex(list=h_grids, index=indexOf)
code_block_9 = CodeBlock(e=getItemAtIndex_2) { e.Name; }
indexOf_2 = List.IndexOf(list=distanceTo_2@L2, element=minimumItem_2@L1)
getItemAtIndex_3 = List.GetItemAtIndex(list=v_grids, index=indexOf_2)
code_block_10 = CodeBlock(e=getItemAtIndex_3) { e.Name; }

# group: Concat
gridLocation = CodeBlock(a=code_block_9, b=code_block_10) { a + b; }

# group: Check
watch_4 = Watch(gridLocation)

# group: Concat
code_block_11 = CodeBlock(level=watch_3, location=watch_4) { level +"."+ location; }

# group: Grouping Rooms by Level.Location
groupByKey_2 = List.GroupByKey(list=all_elements_of_category, keys=code_block_11)

# group: Getting number of items of each sublist
count = List.Count(list=groupByKey_2.groups@L2)

# group: Create Sequences for each sublist
code_block_12 = CodeBlock { 0.01; }
sequence = Sequence(start=code_block_12, amount=count, step=code_block_12)

# group: Convert into String, Get Substring values and Flatten
string_from_object = FromObject(object=sequence)
code_block_13 = CodeBlock { 2; 2; }
substring = String.Substring(string=string_from_object, startIndex=code_block_13.out0, length=code_block_13.out1)
flatten_3 = List.Flatten(list=substring)

# group: Check values
watch_5 = Watch(flatten_3)

# group: Concat
code_block_14 = CodeBlock(level=watch_3, location=watch_4, sequence=watch_5) { level + "." + location + "." + sequence; }

# group: Set values
code_block_15 = CodeBlock { "Number"; }
setParameterByName = Element.SetParameterByName(element=all_elements_of_category, parameterName=code_block_15, value=code_block_14)

# group: Check output!
watch_6 = Watch(code_block_14)

# group: Updated Room number sequence
code_block_16 = CodeBlock()
# ---------- code_block_16.designscript (14 lines) ----------
/*
Updated room number sequence:
	Level.HgridVGrid.sequence
	01.A1.01
	00.B1.10

Sequence starts at each level.location
value
	01.A1.01
	01.A1.02
	01.A2.01
	...

*/;
# ----------------------------------------
