# Dynamo graph Dyn_WIP_LinePatternsCollector.dyn (Dynamo 2.6.2.15705)

python_script = Python()  # unwired: IN[0]
# ---------- python_script.python (19 lines) ----------
import clr
clr.AddReference('RevitAPI')
from Autodesk.Revit.DB import *
clr.AddReference('RevitServices')
from RevitServices.Persistence import DocumentManager
clr.AddReference('RevitNodes')
import Revit
clr.ImportExtensions(Revit.Elements)
doc = DocumentManager.Instance.CurrentDBDocument


pattern_names = []
pattern_ids = []
for type in FilteredElementCollector(doc).OfClass(LinePatternElement).ToElements():
    patterns = type.ToDSType(True)
    pattern_names.append(patterns.Name)
    pattern_ids.append(patterns)
    
OUT = pattern_ids, pattern_names
# ----------------------------------------
code_block = CodeBlock(x=python_script) { pattern_ids = x[0]; pattern_names = x[1]; }
watch = Watch(code_block.pattern_ids)
watch_2 = Watch(code_block.pattern_names)
code_block_2 = CodeBlock { "Center Fine"; }
indexOf = List.IndexOf(list=watch_2, element=code_block_2)
getItemAtIndex = List.GetItemAtIndex(list=watch, index=indexOf)
watch_3 = Watch(getItemAtIndex)
