# Dynamo graph Spatial_Planning_Excel.dyn (Dynamo 2.12.1.8246)

# note: Important stuff
# Purple will indicate something important is going on here.
# note: Checking / Outputs
# Orange indicates checking nodes to ensure the script has deployed correctly.
# note: Working / Functions
# Green indicates the working of the script. No changes should be made in these groups unless advised.
# note: Variables / Inputs
# Red indicates Variables that can be altered per project and must be set accordingly before running the script.

# group: Excel file!
# note: Needed Excel File for creating volumes!

# group: Dyn_13_Spatial Plan from Excel
# note: Workflow
# To be filled in!

# group: Family Name
family_name = CodeBlock { "00_GM_Box"; }

# group: File path
file_path = Filename("Z:\_Javi\_DT\SpaitalPlanning\Program_GM.xlsx")

# group: Excel Worksheet
excel_worksheet_name = CodeBlock { "Rooms_Program"; }

# group: Import Excel file
file_from_path = FileObject(path=file_path)
code_block = CodeBlock { true; false; }
importExcel = Data.ImportExcel(file=file_from_path, sheetName=excel_worksheet_name, readAsStrings=code_block.out0, showExcel=code_block.out1)

string_from_object = FromObject(object=importExcel)

# group: Clean Sheet Imported data Grab items from Excel
# note: clean nulls
# excel > dynamo replace , for .
code_block_2 = CodeBlock(input=string_from_object)
# ---------- code_block_2.designscript (34 lines) ----------
//Get Raw excel data
raw_excel = input;
headers = input[0];
drop_headers = List.DropItems(raw_excel,1);
transpose = List.Transpose(drop_headers);
clean_nulls = String.Replace(transpose, "null" ,"");
clean_data = String.Replace(clean_nulls, "," ,".");


// Gettting All parameters from the schedule
r_department = clean_data[0]

/*
r_department = clean_data[0];
r_sub_department = clean_data[1];
r_function = clean_data[2];
r_typical = clean_data[3];
r_program_number = clean_data[4];
r_number = clean_data[5];
r_name = clean_data[6];

r_program_area = String.ToNumber(clean_data[7]);
r_program_height = Math.Round(String.ToNumber(clean_data[8]) * 1000);
r_program_access_width = clean_data[9];

r_occupancy = clean_data[10];
r_attendance_time = clean_data[11];
r_containment_level = clean_data[12];
r_acoustic_rating = clean_data[13];
r_vibration = clean_data[14];
r_liquids = clean_data[15];
r_gas = clean_data[16];
r_electromagnetic_field = clean_data[17];
*/;
# ----------------------------------------

# group: GroupKeys based on Zoning value
# note: Grouping Keys will be the value column used for grouping excel data
code_block_3 = CodeBlock(clean_data=code_block_2.clean_data, grouping_keys=code_block_2.r_department)
# ---------- code_block_3.designscript (7 lines) ----------
data = clean_data;
grouping_keys;

// Group keys by Zoning
grouped = List.GroupByKey(data<2>,grouping_keys);
groups = Dictionary.ValueAtKey(grouped, "groups" );
List.Transpose(groups);
# ----------------------------------------

# group: Work GroupedKeys Data
code_block_4 = CodeBlock(data=code_block_3.out4)
# ---------- code_block_4.designscript (30 lines) ----------
data;

//Get each data column indivually
r_department = List.GetItemAtIndex(data@L3<1>,0);
r_sub_department = List.GetItemAtIndex(data@L3<1>,1);
r_function = List.GetItemAtIndex(data@L3<1>,2);
r_typical = List.GetItemAtIndex(data@L3<1>,3);
r_program_number = List.GetItemAtIndex(data@L3<1>,4);
r_number = List.GetItemAtIndex(data@L3<1>,5);
r_name = List.GetItemAtIndex(data@L3<1>,6);

r_program_area = String.ToNumber(List.GetItemAtIndex(data@L3<1>,7));
r_program_height = String.ToNumber(List.GetItemAtIndex(data@L3<1>,8)) *1000;
r_program_access_width = List.GetItemAtIndex(data@L3<1>,9);

r_occupancy = List.GetItemAtIndex(data@L3<1>,10);
r_attendance_time = List.GetItemAtIndex(data@L3<1>,11);
r_containment_level = List.GetItemAtIndex(data@L3<1>,12);
r_acoustic_rating = List.GetItemAtIndex(data@L3<1>,13);
r_vibration = List.GetItemAtIndex(data@L3<1>,14);
r_liquids = List.GetItemAtIndex(data@L3<1>,15);
r_gas = List.GetItemAtIndex(data@L3<1>,16);
r_electromagnetic_field = List.GetItemAtIndex(data@L3<1>,17);




// Getting Room side and Maxium values per Zone and total
side = Math.Ceiling(Math.Sqrt(r_program_area * 1000000));
List.MaximumItem(List.Flatten(side)) + 1000;
# ----------------------------------------

# group: Elements spacing
# note: Distance between elements
code_block_5 = CodeBlock { 1000; }

# group: Sub-list cumulative sum
code_block_6 = CodeBlock(input=code_block_4.side, offset=code_block_5)
# ---------- code_block_6.designscript (5 lines) ----------
distance = input + offset;

// First item of each list needs to be placed at 0
add = List.Insert(distance@L2<2>,0,0);
List.DropItems(add@L2<1>,-1);
# ----------------------------------------
python_script = Python(IN[0]=code_block_6.out2)  # CPython3
# ---------- python_script.python (1 lines) ----------
OUT = [[sum(i[:j]) for j in range(1,len(i)+1)] for i in IN[0]]
# ----------------------------------------

# group: Create Placement Points Matrix
code_block_7 = CodeBlock(input=code_block_4.side) { List.Count(input); }
code_block_8 = CodeBlock(number=code_block_7, step=code_block_4.out20) { List.Flatten(0..#number..-step); }
code_block_9 = CodeBlock(x=python_script, y=code_block_8) { Point.ByCoordinates(x,y,0); }

# group: Check Point Matrix
watch = Watch(code_block_9)

# group: Place Family Instances at Points
code_block_10 = CodeBlock(fam_name=family_name) { FamilyType.ByName(fam_name); }
code_block_11 = CodeBlock(fam=code_block_10, point=watch) { FamilyInstance.ByPoint(fam,point); }

# group: Instances
instances = Watch(code_block_11)

code_block_12 = CodeBlock(instances=instances) { List.Flatten(instances); }

# group: Check Headers
watch_2 = Watch(code_block_2.headers)

# group: Get parameter names individually
code_block_13 = CodeBlock(headers=watch_2)
# ---------- code_block_13.designscript (22 lines) ----------
r_department_param = headers[0];
r_sub_department_param = headers[1];
r_function_param = headers[2];
r_typical_param = headers[3];
r_program_number_param = headers[4];
r_number_param = headers[5];
r_name_param = headers[6];
r_program_area_param = headers[7];
r_program_length_param = "R_Program_Length";
r_program_height_param = headers[8];
r_program_access_width_param = headers[9];
r_occupancy_param = headers[10];
r_attendance_time_param = headers[11];
r_containment_level_param = headers[12];
r_acoustic_rating_param = headers[13];
r_vibration_param = headers[14];
r_liquids_param = headers[15];
r_gas_param = headers[16];
r_electromagnetic_param = headers[17];


material_param = headers[6];
# ----------------------------------------

# group: Flatten Values
code_block_14 = CodeBlock(r_department=code_block_4.r_department, r_sub_department=code_block_4.r_sub_department, r_function=code_block_4.r_function, r_typical=code_block_4.r_typical, r_program_number=code_block_4.r_program_number, r_number=code_block_4.r_number, r_name=code_block_4.r_name, r_program_area=code_block_4.r_program_area, r_program_length=code_block_4.side, r_program_height=code_block_4.r_program_height, r_program_access_width=code_block_4.r_program_access_width, r_occupancy=code_block_4.r_occupancy, r_attendance_time=code_block_4.r_attendance_time, r_containment_level=code_block_4.r_containment_level, r_acoustic_rating=code_block_4.r_acoustic_rating, r_vibration=code_block_4.r_vibration, r_liquids=code_block_4.r_liquids, r_gas=code_block_4.r_gas, r_electromagnetic_field=code_block_4.r_electromagnetic_field)
# ---------- code_block_14.designscript (22 lines) ----------
r_department_val = List.Flatten(r_department);
r_sub_department_val = List.Flatten(r_sub_department);
r_function_val = List.Flatten(r_function);
r_typical_val = List.Flatten(r_typical);
r_program_number_val = List.Flatten(r_program_number);
r_number_val = List.Flatten(r_number);
r_name_val = List.Flatten(r_name);

r_program_area_val = List.Flatten(r_program_area);
r_program_length_val = List.Flatten(r_program_length);
r_program_height_val = List.Flatten(r_program_height);
r_program_access_width_val = List.Flatten(r_program_access_width);


r_occupancy_val = List.Flatten(r_occupancy);
r_attendance_time_val = List.Flatten(r_attendance_time);
r_containment_level_val = List.Flatten(r_containment_level);
r_acoustic_rating_val = List.Flatten(r_acoustic_rating);
r_vibration_val = List.Flatten(r_vibration);
r_liquids_val = List.Flatten(r_liquids);
r_gas_val = List.Flatten(r_gas);
r_electromagnetic_field_val = List.Flatten(r_electromagnetic_field);
# ----------------------------------------

# group: Get Model Materials
code_block_15 = CodeBlock { cat = Category.ByName("Materials"); ElementQueries.OfCategory(cat); }

# group: Compare Excel materials with Model Materials
code_block_16 = CodeBlock(materials=code_block_4.r_function, file_materials=code_block_15.out1)
# ---------- code_block_16.designscript (9 lines) ----------
// Inputs
material_list = List.Flatten(materials);
file_materials;

file_materials_name = file_materials.Name;


indices = List.IndexOf(file_materials_name, material_list);
List.GetItemAtIndex(file_materials, indices);
# ----------------------------------------

# group: Replace null values
code_block_17 = CodeBlock { ""; }
isNull = Object.IsNull()  # unwired: object
replaceByCondition = Replace(item=code_block_16.out4, replaceWith=code_block_17, condition=isNull)

# group: Set Data for each instance
code_block_18 = CodeBlock(input=code_block_12, r_department_param=code_block_13.r_department_param, r_sub_department_param=code_block_13.r_sub_department_param, r_function_param=code_block_13.r_function_param, r_typical_param=code_block_13.r_typical_param, r_program_number_param=code_block_13.r_program_number_param, r_number_param=code_block_13.r_number_param, r_name_param=code_block_13.r_name_param, r_program_area_param=code_block_13.r_program_area_param, r_program_length_param=code_block_13.r_program_length_param, r_program_height_param=code_block_13.r_program_height_param, r_program_access_width_param=code_block_13.r_program_access_width_param, r_occupancy_param=code_block_13.r_occupancy_param, r_attendance_time_param=code_block_13.r_attendance_time_param, r_containment_level_param=code_block_13.r_containment_level_param, r_acoustic_rating_param=code_block_13.r_acoustic_rating_param, r_vibration_param=code_block_13.r_vibration_param, r_liquids_param=code_block_13.r_liquids_param, r_gas_param=code_block_13.r_gas_param, r_electromagnetic_field_param=code_block_13.r_electromagnetic_param, r_department_val=code_block_14.r_department_val, r_sub_department_val=code_block_14.r_sub_department_val, r_function_val=code_block_14.r_function_val, r_typical_val=code_block_14.r_typical_val, r_program_number_val=code_block_14.r_program_number_val, r_number_val=code_block_14.r_number_val, r_name_val=code_block_14.r_name_val, r_program_area_val=code_block_14.r_program_area_val, r_program_length_val=code_block_14.r_program_length_val, r_program_height_val=code_block_14.r_program_height_val, r_program_access_width_val=code_block_14.r_program_access_width_val, r_occupancy_val=code_block_14.r_occupancy_val, r_attendance_time_val=code_block_14.r_attendance_time_val, r_containment_level_val=code_block_14.r_containment_level_val, r_acoustic_rating_val=code_block_14.r_acoustic_rating_val, r_vibration_val=code_block_14.r_vibration_val, r_liquids_val=code_block_14.r_liquids_val, r_gas_val=code_block_14.r_gas_val, r_electromagnetic_field_val=code_block_14.r_electromagnetic_field_val, material_val=replaceByCondition)
# ---------- code_block_18.designscript (47 lines) ----------
// Inputs
families = input;
r_department_param;
r_sub_department_param;
r_function_param;
r_typical_param;
r_program_number_param;
r_number_param;
r_name_param;
r_program_area_param;
r_program_length_param;
r_program_height_param;
r_program_access_width_param;
r_occupancy_param;
r_attendance_time_param;
r_containment_level_param;
r_acoustic_rating_param;
r_vibration_param;
r_liquids_param;
r_gas_param;
r_electromagnetic_field_param;


//Set Parameters
Elements.Element.SetParameterByName(families, r_department_param, r_department_val);
Elements.Element.SetParameterByName(families, r_sub_department_param, r_sub_department_val);
Elements.Element.SetParameterByName(families, r_function_param, r_function_val);
Elements.Element.SetParameterByName(families, r_typical_param, r_typical_val);
Elements.Element.SetParameterByName(families, r_program_number_param,r_program_number_val);
Elements.Element.SetParameterByName(families, r_number_param, r_number_val);
Elements.Element.SetParameterByName(families, r_name_param, r_name_val);
Elements.Element.SetParameterByName(families, r_program_area_param, r_program_area_val);
Elements.Element.SetParameterByName(families, r_program_length_param, r_program_length_val);
Elements.Element.SetParameterByName(families, r_program_height_param, r_program_height_val);
Elements.Element.SetParameterByName(families, r_program_access_width_param, r_program_access_width_val);
Elements.Element.SetParameterByName(families, r_occupancy_param, r_occupancy_val);
Elements.Element.SetParameterByName(families, r_attendance_time_param, r_attendance_time_val);
Elements.Element.SetParameterByName(families, r_containment_level_param, r_containment_level_val);
Elements.Element.SetParameterByName(families, r_acoustic_rating_param, r_acoustic_rating_val);
Elements.Element.SetParameterByName(families, r_vibration_param, r_vibration_val);
Elements.Element.SetParameterByName(families, r_liquids_param, r_liquids_val);
Elements.Element.SetParameterByName(families, r_gas_param, r_gas_val);
Elements.Element.SetParameterByName(families, r_electromagnetic_field_param, r_electromagnetic_field_val);



Elements.Element.SetParameterByName(families, "K_Material01" , material_val);
# ----------------------------------------

# group: Cycle Data based on Room Instances
# note: added and if statement at the beginning for i nr instances
code_block_19 = CodeBlock()  # frozen; unwired: input_instances, room_name, room_zoning, required_area, room_height, room_width, room_length, room_material
# ---------- code_block_19.designscript (15 lines) ----------
// Preventing null values in the number of instances
instances = input_instances == 0 ? 1 : input_instances;

// Cycle and Flatten each sublist
u_room_name = List.Flatten(List.Cycle(room_name@L1<1>,instances@L1<1>));
u_room_zoning = List.Flatten(List.Cycle(room_zoning@L1<1>,instances@L1<1>));
u_required_area = List.Flatten(List.Cycle(required_area@L1<1>,instances@L1<1>));
u_room_height = List.Flatten(List.Cycle(room_height@L1<1>,instances@L1<1>));
u_room_width = List.Flatten(List.Cycle(room_width@L1<1>,instances@L1<1>));
u_room_length = List.Flatten(List.Cycle(room_length@L1<1>,instances@L1<1>));
u_room_material = List.Flatten(List.Cycle(room_material@L1<1>,instances@L1<1>));


updated_dataset = [u_room_name, u_room_zoning, u_required_area,
u_room_height, u_room_width, u_room_length, u_room_material];
# ----------------------------------------

# group: Add view filters
current = Document.Current()
activeView = Document.ActiveView(document=current)
addFilter = View.AddFilter(view=activeView)  # unwired: parameterFilter
byRules = Revit.Filter.ParameterFilterElement.ByRules()  # unwired: name, categories, rules

# group: Room fragment view (plans + elevation + 3D)
code_block_20 = CodeBlock {  }

watch_3 = Watch(code_block_16.file_materials_name)
