# Dynamo graph WIP_Dyn_16_SpatialPlanning From Excel.dyn (Dynamo 2.12.1.8246)

# note: Important stuff
# Purple will indicate something important is going on here.
# note: Checking / Outputs
# Orange indicates checking nodes to ensure the script has deployed correctly.
# note: Working / Functions
# Green indicates the working of the script. No changes should be made in these groups unless advised.
# note: Variables / Inputs
# Red indicates Variables that can be altered per project and must be set accordingly before running the script.

# group: Excel file!
# note: Needed Excel File for creating volumes!

# group: Dyn_13_Spatial Plan from Excel
# note: Workflow
# To be filled in!

# group: Family Name
family_name = CodeBlock { "A_VOL_Pièce_SurfaceFixe"; }

# group: File path
file_path = Filename(".\EPFL_Tableau SU_V02.xlsx")

# group: Excel Worksheet
excel_worksheet_name = CodeBlock { "XXX"; }

# group: Import Excel file
file_from_path = FileObject(path=file_path)
code_block = CodeBlock { true; false; }
importExcel = Data.ImportExcel(file=file_from_path, sheetName=excel_worksheet_name, readAsStrings=code_block.out0, showExcel=code_block.out1)

string_from_object = FromObject(object=importExcel)

# group: Clean Sheet Imported data (and repeat values based on instance)
# note: clean nulls
# excel > dynamo replace , for .
code_block_2 = CodeBlock(input=string_from_object)
# ---------- code_block_2.designscript (19 lines) ----------
//Get Raw excel data
raw_excel = input;
headers = input[0];
drop_headers = List.DropItems(raw_excel,1);
transpose = List.Transpose(drop_headers);
clean_nulls = String.Replace(transpose, "null" ,"");
clean_data = String.Replace(clean_nulls, "," ,".");


// Gettting All parameters from the schedule
room_instances = String.ToNumber(clean_data[3]);

room_name = clean_data[0];
room_zoning = clean_data[1];
required_area = String.ToNumber(clean_data[2]);
room_height = Math.Round(String.ToNumber(clean_data[5]) * 1000);
room_width = Math.Round(String.ToNumber(clean_data[6]) * 1000);
room_lenght = Math.Round(String.ToNumber(clean_data[7]) * 1000);
room_material = clean_data[8];
# ----------------------------------------

# group: Cycle Data based on Room Instances
# note: added and if statement at the beginning for i nr instances
code_block_3 = CodeBlock(input_instances=code_block_2.room_instances, room_name=code_block_2.room_name, room_zoning=code_block_2.room_zoning, required_area=code_block_2.required_area, room_height=code_block_2.room_height, room_width=code_block_2.room_width, room_length=code_block_2.room_lenght, room_material=code_block_2.room_material)
# ---------- code_block_3.designscript (15 lines) ----------
// Preventing null values in the number of instances
instances = input_instances == 0 ? 1 : input_instances;

// Cycle and Flatten each sublist
u_room_name = List.Flatten(List.Cycle(room_name@L1<1>,instances@L1<1>));
u_room_zoning = List.Flatten(List.Cycle(room_zoning@L1<1>,instances@L1<1>));
u_required_area = List.Flatten(List.Cycle(required_area@L1<1>,instances@L1<1>));
u_room_height = List.Flatten(List.Cycle(room_height@L1<1>,instances@L1<1>));
u_room_width = List.Flatten(List.Cycle(room_width@L1<1>,instances@L1<1>));
u_room_length = List.Flatten(List.Cycle(room_length@L1<1>,instances@L1<1>));
u_room_material = List.Flatten(List.Cycle(room_material@L1<1>,instances@L1<1>));


updated_dataset = [u_room_name, u_room_zoning, u_required_area,
u_room_height, u_room_width, u_room_length, u_room_material];
# ----------------------------------------

# group: GroupKeys based on Zoning value
# note: Grouping Keys will be the value column used for grouping excel data
code_block_4 = CodeBlock(clean_data=code_block_3.updated_dataset, grouping_keys=code_block_3.u_room_zoning)
# ---------- code_block_4.designscript (7 lines) ----------
data = clean_data;
grouping_keys;

// Group keys by Zoning
grouped = List.GroupByKey(data<2>,grouping_keys);
groups = Dictionary.ValueAtKey(grouped, "groups" );
List.Transpose(groups);
# ----------------------------------------

# group: Work GroupedKeys Data
code_block_5 = CodeBlock(grouped_data=code_block_4.out4)
# ---------- code_block_5.designscript (15 lines) ----------
grouped_data;

//Get each data column
room_name = List.GetItemAtIndex(grouped_data@L3<1>,0);
room_zoning = List.GetItemAtIndex(grouped_data@L3<1>,1);
required_area = List.GetItemAtIndex(grouped_data@L3<1>,2);
room_height = List.GetItemAtIndex(grouped_data@L3<1>,3);
room_width = List.GetItemAtIndex(grouped_data@L3<1>,4);
room_lenght = List.GetItemAtIndex(grouped_data@L3<1>,5);

room_material = List.GetItemAtIndex(grouped_data@L3<1>,6);

// Getting Room side and Maxium values per Zone and total
side = Math.Ceiling(Math.Sqrt(required_area * 1000000));
List.MaximumItem(List.Flatten(side)) + 1000;
# ----------------------------------------

# group: Elements spacing
# note: Distance between elements
code_block_6 = CodeBlock { 1000; }

# group: Sub-list cumulative sum
code_block_7 = CodeBlock(input=code_block_5.room_lenght, offset=code_block_6)
# ---------- code_block_7.designscript (5 lines) ----------
distance = input + offset;

// First item of each list needs to be placed at 0
add = List.Insert(distance@L2<2>,0,0);
List.DropItems(add@L2<1>,-1);
# ----------------------------------------
python_script = Python(IN[0]=code_block_7.out2)  # CPython3
# ---------- python_script.python (1 lines) ----------
OUT = [[sum(i[:j]) for j in range(1,len(i)+1)] for i in IN[0]]
# ----------------------------------------

# group: Create Placement Points Matrix
code_block_8 = CodeBlock(input=code_block_5.room_name) { List.Count(input); }
code_block_9 = CodeBlock(number=code_block_8, step=code_block_5.out9) { List.Flatten(0..#number..-step); }
code_block_10 = CodeBlock(x=python_script, y=code_block_9) { Point.ByCoordinates(x,y,0); }
code_block_11 = CodeBlock(input=code_block_5.room_name) { List.Count(input@L2<1>); }

# group: Check Point Matrix
watch = Watch(code_block_10)

# group: Place Family Instances at Points
code_block_12 = CodeBlock(fam_name=family_name) { FamilyType.ByName(fam_name); }
code_block_13 = CodeBlock(fam=code_block_12, point=watch) { FamilyInstance.ByPoint(fam,point); }

# group: Instances
instances = Watch(code_block_13)

code_block_14 = CodeBlock(instances=instances) { List.Flatten(instances); }

# group: Check Headers
watch_2 = Watch(code_block_2.headers)

# group: Get parameter names individually
code_block_15 = CodeBlock(headers=watch_2)
# ---------- code_block_15.designscript (9 lines) ----------
diname_param = headers[0];
zone_param = headers[1];
area_param = headers[2];
height_param = headers[5];
width_param = headers[6];
lenght_param = headers[7];
material_param = headers[8];

project_length_param = "PP_10D_Projet Longueur";
# ----------------------------------------

# group: Get Model Materials
code_block_16 = CodeBlock { cat = Category.ByName("Materials"); ElementQueries.OfCategory(cat); }

# group: Compare Excel materials with Model Materials
code_block_17 = CodeBlock(materials=code_block_5.room_material, file_materials=code_block_16.out1)
# ---------- code_block_17.designscript (9 lines) ----------
// Inputs
material_list = List.Flatten(materials);
file_materials;

file_materials_name = file_materials.Name;


indices = List.IndexOf(file_materials_name, material_list);
List.GetItemAtIndex(file_materials, indices);
# ----------------------------------------

# group: Replace null values
code_block_18 = CodeBlock { ""; }
isNull = Object.IsNull()  # unwired: object
replaceByCondition = Replace(item=code_block_17.out4, replaceWith=code_block_18, condition=isNull)

# group: Check Parameters
name = Watch(code_block_5.room_name)
zoning = Watch(code_block_5.room_zoning)
required_area = Watch(code_block_5.required_area)
height = Watch(code_block_5.room_height)
width = Watch(code_block_5.room_width)
lenght = Watch(code_block_5.room_lenght)
material = Watch(replaceByCondition)
project_side_size = Watch(code_block_5.side)

# group: Flatten Values
code_block_19 = CodeBlock(name=name, zone=zoning, area=required_area, height=height, width=width, lenght=lenght, material=material, project_width=project_side_size)
# ---------- code_block_19.designscript (9 lines) ----------
input_name = List.Flatten(name);
input_zone = List.Flatten(zone);
input_area = List.Flatten(area);
input_height = List.Flatten(height);
input_width = List.Flatten(width);
input_lenght = List.Flatten(lenght);
input_material = List.Flatten(material);

input_project_length = List.Flatten(project_width);
# ----------------------------------------

# group: Set Data for each instance
code_block_20 = CodeBlock(input=code_block_14, name_param=code_block_15.diname_param, zone_param=code_block_15.zone_param, area_param=code_block_15.area_param, height_param=code_block_15.height_param, width_param=code_block_15.width_param, lenght_param=code_block_15.lenght_param, material_param=code_block_15.material_param, project_lenght_param=code_block_15.project_length_param, input_name=code_block_19.input_name, input_zone=code_block_19.input_zone, input_area=code_block_19.input_area, input_height=code_block_19.input_height, input_width=code_block_19.input_width, input_length=code_block_19.input_lenght, input_material=code_block_19.input_material)
# ---------- code_block_20.designscript (24 lines) ----------
// Inputs
families = input;
name_param;
zone_param;
area_param;
height_param;
width_param;
lenght_param;
material_param;
project_lenght_param;


//Set Parameters
Elements.Element.SetParameterByName(families, name_param, input_name);
Elements.Element.SetParameterByName(families, zone_param, input_zone);
Elements.Element.SetParameterByName(families, area_param, input_area);
Elements.Element.SetParameterByName(families, height_param, input_height);
Elements.Element.SetParameterByName(families, width_param, input_width);
Elements.Element.SetParameterByName(families, lenght_param, input_length);
Elements.Element.SetParameterByName(families, material_param, input_material);


// Set Project element Lenght
Elements.Element.SetParameterByName(families, project_lenght_param, input_length);
# ----------------------------------------

# group: Add view filters
current = Document.Current()
activeView = Document.ActiveView(document=current)
addFilter = View.AddFilter(view=activeView)  # unwired: parameterFilter
byRules = Revit.Filter.ParameterFilterElement.ByRules()  # unwired: name, categories, rules

# group: Room fragment view (plans + elevation + 3D)
code_block_21 = CodeBlock {  }

code_block_22 = CodeBlock(number=code_block_11, step=code_block_5.out9) { (0..#number..step); }
