# Dynamo graph WIP_Dyn_17_View Naming Check.dyn "Dyn_13_View Naming Check" (Dynamo 2.12.1.8246)

# note: Important stuff
# Purple will indicate something important is going on here.
# note: Checking / Outputs
# Orange indicates checking nodes to ensure the script has deployed correctly.
# note: Working / Functions
# Green indicates the working of the script. No changes should be made in these groups unless advised.
# note: Variables / Inputs
# Red indicates Variables that can be altered per project and must be set accordingly before running the script.

# group: Dyn_13_Spatial Plan from Excel
# note: Exercise & Hints
# Create Sheets and fill in Sheet required parameters from an excel worksheet.
# Excel data must be cleaned
# 	 null values, non-desired columns,...
# Not all deliverables in the Excel file are neccesarely Revit Drawings:
# 	If you check Type column only [D] values correspond to Drawings.
#  Try to set  all Sheet Parameters like the did in the previous file
# Challenge: Set Sheet Browser mapping values!
# note: Workflow
# 1. Get Excel Data
# 2. Drop unnecesary Data
# 3. Transpose data so that each columns correspond to a parameter
# 4. Replace null values with empty string
# 5. Filter Type “D”  values (Drawings)
# 6. Get each sublist separately
# 7. Compare Sheet Size With Titleblock Family
# 8. Create Sheets!
# 9. Set Sheet Parameters by using all grabbed data on step 6
# 10. Extra Browser parameter values?

# group: Collect and Clean views
view_collectors_clean = CodeBlock()
# ---------- view_collectors_clean.designscript (12 lines) ----------
// Collect all Views
cat = Category.ByName("Views");
collector =ElementQueries.OfCategory(cat);

// Remove nulls
clean_nulls = List.Clean(collector,false);

// Filter View Templates out (empty family)
view_types = Elements.Element.GetParameterValueByName(clean_nulls,"Family");
empty_values = view_types == "";
bool_mask = List.FilterByBoolMask(clean_nulls, empty_values);
Dictionary.ValueAtKey(bool_mask, "out");
# ----------------------------------------

# group: Filter Deliverable Views only
filter_deliverable_views = CodeBlock(input=view_collectors_clean.out6)
# ---------- filter_deliverable_views.designscript (7 lines) ----------
// Get K_Browser01 value
mapping01 = Elements.Element.GetParameterValueByName(input,"K_Browser01");

// Bool Mask by D_ value
starts_bool = String.StartsWith(mapping01, "D_");
bool_mask = List.FilterByBoolMask(input,starts_bool);
Dictionary.ValueAtKey(bool_mask,"in");
# ----------------------------------------

# group: Check Views
watch = Watch(filter_deliverable_views.out3)

K_Browser03 = CodeBlock()  # unwired: map03
# ---------- K_Browser03.designscript (44 lines) ----------
map03 =="0000" ? "Base documents":
map03 =="0100" ? "Presentation":
map03 =="0200" ? "Plans":
map03 =="0300" ? "Sections":

map03 =="1000" ? "Site plan":
map03 =="1100" ? "Floor plan":
map03 =="1200" ? "Floor plan":
map03 =="1500" ? "Ceiling plan":
map03 =="1600" ? "Ceiling plan":
map03 =="1900" ? "Presentation floor plan":

map03 =="2000" ? "Urban section":
map03 =="2100" ? "Section":
map03 =="2200" ? "Section":
map03 =="2900" ? "Presentation Section":

map03 =="3000" ? "Elevation":
map03 =="3100" ? "Elevation":
map03 =="3200" ? "Elevation":
map03 =="3900" ? "Presentation Elevation":

map03 =="4100" ? "Fragment":
map03 =="4200" ? "Fragment":

map03 =="5000" ? "Detail":
map03 =="5100" ? "Detail":
map03 =="5200" ? "Detail":

map03 =="6100" ? map03+"_Doors and windows - exterior":
map03 =="6200" ? map03+"_Doors and windows - interior":
map03 =="6300" ? map03+"_Prefabricated elements":

map03 =="7000" ? "Furniture":
map03 =="7100" ? "Furniture":
map03 =="7200" ? "Furniture":

map03 =="8100" ? "Area plan":
map03 =="8200" ? "Fire security":
map03 =="8300" ? "Finishes":

map03 =="9100" ? "Existing plans":
map03 =="9200" ? "Demolition plans":
null;
# ----------------------------------------
code_block = CodeBlock(input=filter_deliverable_views.out3) { Elements.Element.SetParameterByName(input,"View Name", values); }  # frozen; unwired: values
code_block_2 = CodeBlock { 0.01..#number..0.01; }  # unwired: number
string_from_object = FromObject(object=code_block_2)
code_block_3 = CodeBlock(input=string_from_object) { String.Substring(input,2,2); }

# group: Filtering function
function = CodeBlock()
# ---------- function.designscript (10 lines) ----------
def filtering(views, filtering_val)
{
// Filter values based on input
values = Elements.Element.GetParameterValueByName(views,"K_Browser03");
string_bool = String.StartsWith(values,filtering_val);
bool_mask = List.FilterByBoolMask(views,string_bool);
filtered_views = Dictionary.ValueAtKey(bool_mask, "in");

return filtered_views;
};
# ----------------------------------------

code_block_4 = CodeBlock()  # unwired: functional_breakdown, spatial_breakdown, map03, description, scale
# ---------- code_block_4.designscript (3 lines) ----------
"D_" + functional_breakdown + "_" +
spatial_breakdown + "_" + map03 + "_" +
description + "_" + scale;
# ----------------------------------------

# group: Input filtering
# note: Filtering rules (starting with)
filtering_rules = CodeBlock()
# ---------- filtering_rules.designscript (9 lines) ----------
base = "0";
floor_plans = "1";
section = "2";
elevation = "3";
fragment = "4";
detail = "5";
element = "6";
furniture = "7";
overview = "8";
# ----------------------------------------

# group: Filtering Views
getting_ga_plans = CodeBlock(views=filter_deliverable_views.out3, base_filtering=filtering_rules.base, floorplan_filtering=filtering_rules.floor_plans, section_filtering=filtering_rules.section, elevation_filtering=filtering_rules.elevation, fragment_filtering=filtering_rules.fragment, detail_filtering=filtering_rules.detail, element_filtering=filtering_rules.element, furniture_filtering=filtering_rules.furniture, overview_filtering=filtering_rules.overview)
# ---------- getting_ga_plans.designscript (27 lines) ----------
// Inputs
views;

base_filtering;
floorplan_filtering;
section_filtering;
elevation_filtering;
fragment_filtering;
detail_filtering;
element_filtering;
furniture_filtering;
overview_filtering;

// Filtering view based on Filtering Rules
base_views = List.Flatten(filtering(views, base_filtering));
floorplans = List.Flatten(filtering(views, floorplan_filtering));
sections = List.Flatten(filtering(views, section_filtering));
elevations = List.Flatten(filtering(views, elevation_filtering));
fragments = List.Flatten(filtering(views, fragment_filtering));
details = List.Flatten(filtering(views, detail_filtering));
elements = List.Flatten(filtering(views, element_filtering));
furniture = List.Flatten(filtering(views, furniture_filtering));
overview = List.Flatten(filtering(views, overview_filtering));


view_list = [base_views,floorplans,sections,elevations,fragments,
details,elements,furniture,overview];
# ----------------------------------------

code_block_5 = CodeBlock(input=getting_ga_plans.view_list) { List.Flatten(collect_data(input)); }

# group: Check View Names
watch_2 = Watch(code_block_5)

# group: Collecting data function
function_2 = CodeBlock()
# ---------- function_2.designscript (37 lines) ----------
def collect_data(input)
{
Kmap03 = Elements.Element.GetParameterValueByName(input,"K_Browser03");
scope_box = Elements.Element.GetParameterValueByName(input,"Scope Box");
view_level = Elements.Element.GetParameterValueByName(input,"Associated Level");
view_scale = Elements.Element.GetParameterValueByName(input,"Scale Value    1:");


// Get map03 value
map03_split = String.Split(Kmap03,"_");
map03 = List.GetItemAtIndex(map03_split@L2<1>,0);

// Get Spatial Breakdown value
spatial_code = String.Substring(view_level,0,2);
spatial_breakdown = spatial_code == null ? "ZZ" : spatial_code;

// Get Scale value
scale = "1-" + view_scale;

// Description Value
description = List.GetItemAtIndex(map03_split@L2<1>,1) + " - level " + spatial_breakdown;

// Get functional breakdown
scope_name = scope_box.Name;
functional_breakdown = scope_name == "Totaal" ? "ZZ":
scope_name == "Bouwdeel A" ? "BA":
scope_name == " Bouwdeel B" ? "BB":
"ZZ";


// View name
view_name = "D_" + functional_breakdown + "_" +
spatial_breakdown + "_" + map03 + "_" +
description + "_" + scale;

return view_name;
};
# ----------------------------------------
