# Dynamo graph WIP_Grab ObjectStyles.dyn (Dynamo 2.12.0.5650)

# group: Families Collector
python_script = Python()  # CPython3; unwired: IN[0]
# ---------- python_script.python (44 lines) ----------
"""
FILTERED ELEMENT COLLECTOR
"""
__author__ = 'Sol Amour - amoursol@gmail.com'
__twitter__ = '@solamour'
__version__ = '1.0.0'

# Importing Reference Modules
import clr # CLR ( Common Language Runtime Module )
clr.AddReference("RevitServices") # Adding the RevitServices.dll special Dynamo
# module to deal with Revit
import RevitServices # Importing RevitServices
from RevitServices.Persistence import DocumentManager # From RevitServices import
# the Document Manager
clr.AddReference("RevitAPI") # Adding the RevitAPI.dll module to access the Revit
# API
import Autodesk # Here we import the Autodesk namespace
# From the Autodesk namespace - derived down to the Revit Database, we import only
# the Filtered Element Collector and BuiltInCategory classes
from Autodesk.Revit.DB import FilteredElementCollector, FamilyInstance, Family

# Here we give the Revit Document a nickname of 'doc' which allows us to simply
# call 'doc' later without having to type the long namespace name
doc = DocumentManager.Instance.CurrentDBDocument

familyInstanceCollector = FilteredElementCollector(doc).OfClass(FamilyInstance).WhereElementIsNotElementType().ToElements()

systemFamilies = FilteredElementCollector(doc).WhereElementIsElementType().ToElements()

inPlaceFamilies = []

# Collect all InPlace families
for instance in familyInstanceCollector:
	symbol = instance.Symbol.Family
	if symbol.IsInPlace:
		inPlaceFamilies.append(instance)

loadableFamilies = [family for family in familyInstanceCollector if family not in inPlaceFamilies]

# Create a dictionary to output
output = {'inPlaceFamilies' : inPlaceFamilies, 'loadableFamilies' : loadableFamilies, 'systemFamilies' : systemFamilies}

# To get our results back inside of Dynamo, we need to append a list to the OUT port
OUT = output
# ----------------------------------------

code_block = CodeBlock(t1=python_script)
# ---------- code_block.designscript (3 lines) ----------
Dictionary.ValueAtKey(t1, "systemFamilies");
Dictionary.ValueAtKey(t1, "loadableFamilies");
Dictionary.ValueAtKey(t1, "inPlaceFamilies");
# ----------------------------------------
code_block_2 = CodeBlock(e=code_block.out1)
# ---------- code_block_2.designscript (5 lines) ----------
fam_type = Element.GetParameterValueByName(e, "Family");
family = FamilyType.Family(fam_type);

//Grabbing unique items
List.UniqueItems(family);
# ----------------------------------------
family_get_subcategory = Python(IN[0]=code_block_2.out2)  # IronPython2
# ---------- family_get_subcategory.python (51 lines) ----------
#Alban de Chasteigner 2019
#twitter : @geniusloci_bim
#geniusloci.bim@gmail.com

import clr
clr.AddReference("RevitAPI")
import Autodesk
from Autodesk.Revit.DB import *

clr.AddReference("RevitNodes")
import Revit
clr.ImportExtensions(Revit.Elements)

clr.AddReference("RevitServices")
import RevitServices
from RevitServices.Persistence import DocumentManager
from RevitServices.Transactions import TransactionManager
doc = DocumentManager.Instance.CurrentDBDocument

families = UnwrapElement(IN[0]) if isinstance(IN[0],list) else [UnwrapElement(IN[0])]
fCat,subCategory = [],[]

TransactionManager.Instance.ForceCloseTransaction()
for fam in families:
	if isinstance(fam,FamilyInstance):
		family=fam.Symbol.Family
		if family.IsEditable :
			famDoc = doc.EditFamily(family)
			cate=Revit.Elements.Category.ById((family.FamilyCategoryId).IntegerValue)
	elif isinstance(fam,Family):
		#if fam.IsInPlace == False :
		if fam.IsEditable :
			family=fam
		famDoc = doc.EditFamily(family)
		cate=Revit.Elements.Category.ById((family.FamilyCategoryId).IntegerValue)
	#elif isinstance(fam,Document):
		#famDoc = fam
		#cate=Revit.Elements.Category.ById((famDoc.OwnerFamily.FamilyCategoryId).IntegerValue)
	else: pass	
	category = famDoc.OwnerFamily.FamilyCategory
	subcat=category.SubCategories
	for i in subcat:
		try:
			subCategory.append(Revit.Elements.Category.ById(i.Id.IntegerValue))
		except : subCategory.append(None)
	fCat.append(cate)
	if not isinstance(fam,Document):
		famDoc.Close(False)
	
if isinstance(IN[0], list): OUT = fCat,subCategory
else: OUT = fCat[0],subCategory
# ----------------------------------------
code_block_3 = CodeBlock(x=family_get_subcategory) { category_name = x[0]; subcategories = x[1]; }
get_subcategories_properties = Python(IN[0]=code_block_3.subcategories)  # IronPython2
# ---------- get_subcategories_properties.python (45 lines) ----------
import clr
clr.AddReference('RevitAPI')
from Autodesk.Revit.DB import *

clr.AddReference("RevitNodes")
import Revit
clr.ImportExtensions(Revit.Elements)

clr.AddReference('DSCoreNodes')
import DSCore
from DSCore import Color

clr.AddReference("RevitServices")
import RevitServices
from RevitServices.Persistence import DocumentManager
from RevitServices.Transactions import TransactionManager

doc = DocumentManager.Instance.CurrentDBDocument
subcat = UnwrapElement(IN[0])
if not hasattr(subcat, '__iter__'):
    subcat = [subcat]

listGraph,listPattern,patname,listpatid,lineProjWeight,lineProjCut,listRGB,listMaterial = [],[],[],[],[],[],[],[]

for i in subcat:
	id = i.GetLinePatternId(GraphicsStyleType.Projection)
	pat = LinePatternElement.GetLinePattern(doc,id)
	projWeight = i.GetLineWeight(GraphicsStyleType.Projection)
	cutWeight = i.GetLineWeight(GraphicsStyleType.Cut)
	rgb = DSCore.Color.ByARGB(255,i.LineColor.Red, i.LineColor.Green, i.LineColor.Blue)
	listMaterial.append(i.Material)
	listRGB.append(rgb)
	lineProjWeight.append(projWeight)
	lineProjCut.append(cutWeight)
	listPattern.append(pat)
	listpatid.append(doc.GetElement(id))
	try:
		patname.append(pat.Name)
	except:
		patname.append("Solid")
		
	style = i.GetGraphicsStyle(GraphicsStyleType.Projection)
	listGraph.append(style)

OUT = listGraph, listpatid, patname, lineProjWeight, lineProjCut,listRGB,listMaterial
# ----------------------------------------
code_block_4 = CodeBlock(x=get_subcategories_properties)
# ---------- code_block_4.designscript (7 lines) ----------
graphic_style = x[0];
line_pattern = x[1];
line_pattern_name = x[2];
projection_line_weight = x[3];
cut_line_weight =x[4];
line_color = x[5];
material = x[6];
# ----------------------------------------
