# Dynamo graph WIP_SpatialPlanningCuboid.dyn "Cuboid" (Dynamo 2.12.0.5650)
# packages: Refinery Toolkit 1.1.1

select_model_element = DSModelElementSelection()  # 1 picked in the model
geometry = Element.Geometry(element=select_model_element)
flatten = List.Flatten(list=geometry)
code_block = CodeBlock { 168; 218; 220; }
byARGB = Color.ByARGB(red=code_block.out0, green=code_block.out1, blue=code_block.out2)
select_model_elements = DSModelElementsSelection()  # 409 picked in the model
geometry_2 = Element.Geometry(element=select_model_elements)
string_from_object = FromObject(object=geometry_2)
code_block_2 = CodeBlock { "Solid"; }
eq = string_from_object == code_block_2
filterByBoolMask = List.FilterByBoolMask(list=geometry_2, mask=eq)
flatten_2 = List.Flatten(list=filterByBoolMask.in)
byGeometry = BoundingBox.ByGeometry(geom=flatten_2@L1)
toCuboid = BoundingBox.ToCuboid(boundingBox=byGeometry)
byGeometry_2 = BoundingBox.ByGeometry(geom=geometry@L1)
toCuboid_2 = BoundingBox.ToCuboid(boundingBox=byGeometry_2)
packCuboids = Autodesk.RefineryToolkits.SpacePlanning.Generate.Packing.PackCuboids(items=toCuboid, containers=toCuboid_2)
explode = Geometry.Explode(geometry=packCuboids.Packed_Items)
byJoinedSurfaces = Solid.ByJoinedSurfaces(facesOfSolid=explode)
flatten_3 = List.Flatten(list=byJoinedSurfaces)
color_palette = ColorPalette({R: 168, G: 218, B: 238, A: 255})
overrideColorInView = Element.OverrideColorInView(element=flatten_3, color=color_palette)
color_palette_2 = ColorPalette({R: 155, G: 214, B: 251, A: 255})
overrideColorInView_2 = Element.OverrideColorInView(element=select_model_element, color=color_palette_2)  # frozen
code_block_3 = CodeBlock { 60; 241; 250; 238; }
byARGB_2 = Color.ByARGB(alpha=code_block_3.out0, red=code_block_3.out1, green=code_block_3.out2, blue=code_block_3.out3)
